# Grasshopper definition Weaverbird + exoskeleton 03.gh (Grasshopper 0.9.76)
# plug-ins: Exoskeleton2, Human, Weaverbird

strut_width_at_base = Slider(12.578, range=0..18)
strut_width_at_top = Slider(2, range=0..18)
vase_width = Slider(274, range=0..300)
curves = Slider(12, range=0..30)
vase_height = Slider(609, range=0..700)
multiplication = Multiplication(A="2", B=curves)
dom = ConstructDomain(DomainStart=strut_width_at_base, DomainEnd=strut_width_at_top)
range = Range(Domain=vase_height, Steps=multiplication)
range_2 = Range(Domain=Domain(0, 1), Steps=multiplication)
range_3 = Range(Domain="0 to 2*Pi", Steps=multiplication)

# ---- group: vase profile
graph = GraphMapper(
    range_2,
    x0=0,
    x1=1,
    y0=0,
    y1=1,
    amplitude=0.461730957,
    container_name="Perlin",
    decay=0.1417813897,
    frequency=0.2640803456,
    x_offset=0.6379020214,
    y_offset=0.6030654907)

# ----
pt = ConstructPoint(XCoordinate=0, YCoordinate=0, ZCoordinate=range)
remap = RemapNumbers(Value=graph, Source=Domain(0, 1), Target=vase_width)  # -> Mapped, Clipped
pt_2 = PointPolar(BasePlane=pt, XYAngle=range_3, ZAngle=0, Offset=remap.Mapped)
range_4 = Range(Domain="0 to 2*Pi", Steps=curves)
item = ListItem(List=pt, Index=0, Wrap=True)
pline = PolyLine(Vertices=pt_2, Closed=False)
shift = ShiftList(List=range_4, Shift=1, Wrap=False)
xz = XZPlane(Origin=item)
rotate = Rotate(Geometry=pline, Angle=shift, Plane=item)  # -> Geometry, Transform
mirror = Mirror(Geometry=rotate.Geometry, Plane=xz)  # -> Geometry, Transform
merge = Merge(Data1=mirror.Geometry, Data2=rotate.Geometry)
explode = Explode(Curve=merge, Recursive=True)  # -> flatten(Segments), Vertices
panel = Panel("""0
1""")
pdecon = Deconstruct(Point=flatten(explode.Vertices))  # -> XComponent, YComponent, ZComponent
eval = EvaluateLength(Curve=simplify(graft(explode.Segments)), Length=panel, Normalized=True)  # -> Point, Tangent, Parameter
bnd = Bounds(Numbers=pdecon.ZComponent)
pdecon_2 = Deconstruct(Point=eval.Point)  # -> XComponent, YComponent, ZComponent
remap_2 = RemapNumbers(Value=pdecon_2.ZComponent, Source=bnd, Target=dom)  # -> Mapped, Clipped
dispatch = Dispatch(List=remap_2.Mapped, DispatchPattern=[True, False])  # -> flatten(ListA), flatten(ListB)
exow = ExoWireframe(
    Lines=explode.Segments,
    Sides="6",
    StartRadius=dispatch.ListA,
    EndRadius=dispatch.ListB,
    NodeDepth=Slider(0, range=0..70),
    Division=Slider(30, range=0..200),
    Open=False)
wblaplace = WeaverbirdsLaplacianSmoothing(MeshCurves=exow, Level=1, SmoothNakedEdges=1, Thin=1)
wbloop = WeaverbirdsLoopSubdivision(MeshCurves=wblaplace, Level="2", SmoothNakedEdges=1)
previewmat = CustomPreviewMaterials(Geometry=wbloop, DiffuseColor=RGB(255, 255, 255))
