# Grasshopper definition Zaliczenie Elliason pattern 2.gh (Grasshopper 0.9.76)

ilosc_podzialow = Slider(34, range=0..40)
glebokosc = Slider(14, range=0..20)
promien = Slider(200, range=0..200)
xz = XZPlane(Origin=Point(0, 0, 0))
cir = Circle(Plane=xz, Radius=promien)
multiplication = Multiplication(A=ilosc_podzialow, B="2")
divide = DivideCurve(Curve=cir, Count=multiplication, Kinks=False)  # -> Points, Tangents, Parameters
cull = CullPattern(List=divide.Points, CullPattern=[False, True])
cull_2 = CullPattern(List=divide.Points, CullPattern=invert([False, True]))
Y = UnitY(Factor=expr("-x", glebokosc))
move = Move(Geometry=cull, Motion=Y)  # -> Geometry, Transform
weave = Weave(Pattern=[0, 1], Stream0=cull_2, Stream1=move.Geometry, NullGaps=False)
ln = Line(StartPoint=weave, EndPoint=xz)
loft = Loft(Curves=ln, Options={Adjust=False, Closed=True, LoftEnds=0, LoftSimp=0, LoftType=3, Rebuild=10, Refit=0.01})
