# Grasshopper definition attraktor 2d 1.gh (Grasshopper 0.9.76)

series = Series(Start=0, Step=Slider(10, range=0..20), Count=Slider(10, range=0..10))
pt = ConstructPoint(XCoordinate=graft(series), YCoordinate=series, ZCoordinate=0)  # -> flatten(Point)
pt_2 = ConstructPoint(XCoordinate=Slider(121, range=-100..200), YCoordinate=Slider(55, range=-100..200), ZCoordinate=0)
cir = Circle(Plane=pt_2, Radius=3)
dist = Distance(PointA=pt, PointB=pt_2)
bnd = Bounds(Numbers=dist)
dom = ConstructDomain(DomainStart=Slider(1, range=1..10), DomainEnd=Slider(10, range=1..10))
remap = RemapNumbers(Value=dist, Source=bnd, Target=dom)  # -> Mapped, Clipped
cir_2 = Circle(Plane=pt, Radius=remap.Mapped)
