# Grasshopper definition milipede 2d 01.gh (Grasshopper 0.9.76)
# plug-ins: Millipede

crv_boundary_opening = Curve(<curve referenced from the Rhino model>)
boundary = _2DBoundaryRegion(Boundary=crv_boundary_opening, IsVoid=Toggle(True))

crv_boundary = Curve(<curve referenced from the Rhino model>)
boundary_2 = _2DBoundaryRegion(Boundary=crv_boundary, IsVoid=False)

crv_support = Curve(<curve referenced from the Rhino model>)
mat = MillC_StockSupportType(X=True, Y=True, Z=True, RX=True, RY=True, RZ=True)
support = _2DSupportRegion(Boundary=crv_support, SupportType=mat, AmendExistingSupports=Toggle(True), Displacement=Vector(0, 0, 0))

crv_weight = Curve(<curve referenced from the Rhino model>)
Y = UnitY(Factor=Slider(-2160, range=-3000..0))
load = _2DLoadRegion(Boundary=crv_weight, Load=Y)

topostruct_2d = Topostruct2DModel(ModelComponents=[boundary_2, load, support, boundary], XResolution=Slider(100, range=0..100))  # -> FEModel, CellCentres, CellSize
topostruct_2d_solver = Topostruct2DSolver(
    FEModel=topostruct_2d.FEModel,
    SelfWeightCoefficient=0,
    OptimizationIterations=Slider(8, range=0..10),
    Smoothing=0.1,
    Penalization=3,
    TargetDensity=Slider(0.25, range=0..1),
    MinimumDensity=0.001,
    DeleteThreshold=0.5,
    PeriodicX=False,
    PeriodicY=False,
    LoadCase=0,
    AllCases=True,
    CompliantMechanism=False)  # -> FEModel, MaxDeflection

pt = Point(<point referenced from the Rhino model>)
division = Division(A=Slider(0, range=0..4), B=topostruct_2d_solver.MaxDeflection)
_2d_iso_contour = _2DIsoContour(FEModel=topostruct_2d_solver.FEModel, Deflection=0, IsoContourValue=Slider(0.419, range=0..1))
stress_lines = StressLines(FEModel=topostruct_2d_solver.FEModel, Seeds=pt)  # -> Curves1, Curves2
_2d_mesh_results = _2DMeshResults(FEModel=topostruct_2d_solver.FEModel, Deflection=division, ColorMode=0)

contour = Contour(_2d_iso_contour)
curves1 = Curves1(stress_lines.Curves1)
mesh = Mesh(_2d_mesh_results)
