# Grasshopper definition milipede 3d 01 krzeslo 2.gh (Grasshopper 0.9.76)
# plug-ins: MeshEdit Components, Millipede, Bowerbird

crv = Curve(<curve referenced from the Rhino model>)

brep_support = Brep([<brep referenced from the Rhino model> x3])
mat = MillC_StockSupportType(X=True, Y=True, Z=True, RX=True, RY=True, RZ=True)
support = _3DSupportRegion(Boundary=brep_support, SupportType=mat, AmendExistingSupports=True)

curvepoint = PointOnCurve(crv, parameter=0)
curvepoint_2 = PointOnCurve(crv, parameter=1)

brep_boundary = Brep(<brep referenced from the Rhino model>)
boundary = _3DBoundaryRegion(Boundary=brep_boundary, IsVoid=Toggle(False))

brep_weight = Brep([<brep referenced from the Rhino model> x2])
vec2pt = Vector2Pt(PointA=curvepoint, PointB=curvepoint_2, Unitize=False)  # -> Vector, Length
neg = Negative(Value=Slider(7700, range=0..500000))
unit = UnitVector(Vector=vec2pt.Vector)
Y = UnitY(Factor=neg)
multiplication = Multiplication(A=neg, B=unit)
load = _3DLoadRegion(Boundary=brep_weight, Load=multiplication)

slider_xr = Slider(20, range=2..100)
slider_target_density = Slider(0.2, range=0..1)
slider_iterations = Slider(20, range=0..40)
slider_smoothing = Slider(0.13, range=0..1)
topostruct_3d = Topostruct3DModel(ModelComponents=[load, support, boundary], XResolution=slider_xr)  # -> FEModel, CellCentres, CellSize
topostruct_3d_solver = Topostruct3DSolver(
    FEModel=topostruct_3d.FEModel,
    SelfWeightCoefficient=0,
    OptimisationIterations=slider_iterations,
    Smoothing=slider_smoothing,
    Penalization=3,
    TargetDensity=slider_target_density,
    MinimumDensity=0.001,
    DeleteThreshold=0.5,
    PeriodicX=False,
    PeriodicY=False,
    PeriodicZ=False,
    LoadCase=0,
    AllCases=True)  # -> FEModel, MaxDeflection

division = Division(A=Slider(0, range=0..10), B=topostruct_3d_solver.MaxDeflection)

_3d_iso_mesh = _3DIsoMesh(FEModel=topostruct_3d_solver.FEModel, Deflection=division, IsoContourValue=Slider(0.28, range=0..1), ColorMode=3)
preview = CustomPreview(Geometry=_3d_iso_mesh, Shader=ColourSwatch(SwatchColor=RGB(181, 181, 181)))

number_slider = Slider(7, range=4..15)
number_slider_2 = Slider(2, range=1..4)
number_slider_3 = Slider(7, range=4..15)
xy = XYPlane(Origin=Point(0, 0, 0))
rotate = Rotate(Geometry=xy, Angle=degrees(Slider(45, range=-90..90)), Plane=PlaneXY(0, 0, 0))  # -> Geometry, Transform
X = UnitX(Factor=1)
mesh = Mesh(_3d_iso_mesh)
rot3d = Rotate3D(Geometry=rotate.Geometry, Angle=degrees(Slider(-45, range=-90..90)), Center=Point(0, 0, 0), Axis=X)  # -> Geometry, Transform
flip = MeshFlip(Mesh=mesh)
move = Move(Geometry=flip, Motion=Vector(0, -98.85960787, 0))  # -> Geometry, Transform
mesh_2 = Mesh(move.Geometry)
bbwaffle = BBWaffle(
    Mesh=mesh_2,
    CountX=number_slider,
    CountY=number_slider_3,
    Thickness=number_slider_2,
    Plane=rot3d.Geometry,
    Deeper=0,
    Project=False,
    Distance=1)  # -> SlicesU, SlicesV, SectionPlanesU, SectionPlanesV
bbwaffle_2 = BBWaffle(
    Mesh=mesh_2,
    CountX=number_slider,
    CountY=number_slider_3,
    Thickness=number_slider_2,
    Plane=rot3d.Geometry,
    Deeper=0,
    Project=True,
    Distance=1)  # -> SlicesU, SlicesV, flatten(SectionPlanesU), flatten(SectionPlanesV)
srf = Surface(bbwaffle.SlicesV)
srf_2 = Surface(bbwaffle.SlicesU)
Y_2 = UnitY(Factor="-100")

lng = ListLength(List=bbwaffle_2.SectionPlanesV)
item = ListItem(List=bbwaffle_2.SlicesV, Index=0, Wrap=True)
md_slider = MDSlider(
    slider_value=Point(0.6906280518, 0.5875015259, 0.5),
    SliderMode=0,
    x_domain=Domain(0, 1),
    y_domain=Domain(0, 1),
    z_domain=Domain(0, 1))
series = Series(Start=0, Step=1, Count=lng)
evalsrf = EvaluateSurface(Surface=reparameterize(item), Point=md_slider)  # -> flatten(Point), Normal, Frame
int = Integer(series)
concat = Concatenate(FragmentA="Y", FragmentB=int)
bbtext = BBText(Location=evalsrf.Point, Text=concat, Size="10", Bold=False, HorizontalAlignment=0, VerticalAlignment=0)

lng_2 = ListLength(List=bbwaffle_2.SectionPlanesU)
item_2 = ListItem(List=bbwaffle_2.SlicesU, Index=0, Wrap=True)
md_slider_2 = MDSlider(
    slider_value=Point(0.6906280518, 0.5875015259, 0.5),
    SliderMode=0,
    x_domain=Domain(0, 1),
    y_domain=Domain(0, 1),
    z_domain=Domain(0, 1))
series_2 = Series(Start=0, Step=1, Count=lng_2)
evalsrf_2 = EvaluateSurface(Surface=reparameterize(item_2), Point=md_slider_2)  # -> flatten(Point), Normal, Frame
int_2 = Integer(series_2)
concat_2 = Concatenate(FragmentA="X", FragmentB=int_2)
bbtext_2 = BBText(Location=evalsrf_2.Point, Text=concat_2, Size="10", Bold=False, HorizontalAlignment=0, VerticalAlignment=0)

move_2 = Move(Geometry=mesh_2, Motion=Y_2)  # -> Geometry, Transform
move_3 = Move(Geometry=srf, Motion=Y_2)  # -> Geometry, Transform
move_4 = Move(Geometry=srf_2, Motion=Y_2)  # -> Geometry, Transform
