# Grasshopper definition Elliason GH 4 pattern 02.gh (Grasshopper 0.9.76)

dlugosc = Slider(282, range=0..400)
wysokosc = Slider(137, range=0..400)
pt = ConstructPoint(XCoordinate=0, YCoordinate=0, ZCoordinate=0)
X = UnitX(Factor=1)
Z = UnitZ(Factor=wysokosc)
line = LineSDL(Start=pt, Direction=X, Length=dlugosc)
move = Move(Geometry=line, Motion=Z)  # -> Geometry, Transform
range = Range(Domain=Domain(0, 1), Steps=Slider(4, range=0..10))
range_2 = Range(Domain=Domain(0, 1), Steps=Slider(9, range=0..10))
md_slider = MDSlider(slider_value=Point(0, 1, 0.5), SliderMode=0, x_domain=Domain(0, 1), y_domain=Domain(0, 1), z_domain=Domain(0, 1))
md_slider_2 = MDSlider(slider_value=Point(1, 0, 0.5), SliderMode=0, x_domain=Domain(0, 1), y_domain=Domain(0, 1), z_domain=Domain(0, 1))
loft = Loft(
    Curves=[line, move.Geometry],
    Options={Adjust=False, Closed=False, LoftEnds=0, LoftSimp=0, LoftType=0, Rebuild=10, Refit=0.01})
pt_2 = ConstructPoint(XCoordinate=graft(range), YCoordinate=range_2, ZCoordinate=0)
evalsrf = EvaluateSurface(Surface=reparameterize(loft), Point=md_slider)  # -> Point, Normal, Frame
evalsrf_2 = EvaluateSurface(Surface=reparameterize(loft), Point=md_slider_2)  # -> Point, Normal, Frame
evalsrf_3 = EvaluateSurface(Surface=reparameterize(loft), Point=flatten(pt_2))  # -> Point, Normal, Frame
dist = Distance(PointA=evalsrf.Point, PointB=evalsrf_3.Point)
dist_2 = Distance(PointA=evalsrf_2.Point, PointB=evalsrf_3.Point)
merge = Merge(Data1=graft(dist), Data2=graft(dist_2))
sort = SortList(Keys=merge)  # -> Keys, ValuesA
item = ListItem(List=sort.Keys, Index=0, Wrap=True)  # -> flatten(Item)
bnd = Bounds(Numbers=item)
dom = ConstructDomain(DomainStart=Slider(0, range=0..90), DomainEnd=Slider(90, range=0..90))
remap = RemapNumbers(Value=item, Source=bnd, Target=dom)  # -> Mapped, Clipped
cir = Circle(Plane=evalsrf_3.Frame, Radius=Slider(13, range=0..90))
rotate = Rotate(Geometry=cir, Angle=simplify(degrees(remap.Mapped)), Plane=evalsrf_3.Point)  # -> Geometry, Transform
rotate_2 = Rotate(Geometry=rotate.Geometry, Angle=simplify(degrees(remap.Mapped)), Plane=evalsrf_3.Frame)  # -> Geometry, Transform
srf = Surface(rotate_2.Geometry)
