# Grasshopper definition Elliason GH 6 pattern.gh (Grasshopper 0.9.76)

number_slider = Slider(53, range=-200..200)
pt = ConstructPoint(XCoordinate=0, YCoordinate=0, ZCoordinate=0)
pt_2 = ConstructPoint(XCoordinate=Slider(35, range=-200..200), YCoordinate=0, ZCoordinate=Slider(189, range=-200..200))
pt_3 = ConstructPoint(XCoordinate=number_slider, YCoordinate=0, ZCoordinate=Slider(199, range=-200..200))
range = Range(Domain=Domain(0, 1), Steps=Slider(7, range=0..10))
merge = Merge(Data1=pt, Data2=pt_2, Data3=pt_3)
X = UnitX(Factor=number_slider)
graph = GraphMapper(
    range,
    x0=0,
    x1=1,
    y0=0,
    y1=1,
    container_name="Bezier",
    cpx=[0, 0.1613654494, 0.5389099121, 1],
    cpy=[0, 0.5099619627, 0.9112513661, 1])
neg = Negative(Value=X)
move = Move(Geometry=merge, Motion=neg)  # -> Geometry, Transform
number_slider_2 = Slider(26, range=0..40)
ln = Line(StartPoint=move.Geometry, EndPoint=pt)
intcrv = Interpolate(Vertices=move.Geometry, Degree=3, Periodic=False, KnotStyle=1)  # -> Curve, Length, Domain

scale = Scale(Geometry=intcrv.Curve, Center=Point(0, 0, 0), Factor=Slider(0.876, range=0..1))  # -> Geometry, Transform

Y = UnitY(Factor=number_slider_2)
eval = EvaluateLength(Curve=ln, Length=Slider(10, range=0..10), Normalized=False)  # -> Point, Tangent, Parameter
intcrv_2 = Interpolate(Vertices=eval.Point, Degree=3, Periodic=False, KnotStyle=1)  # -> Curve, Length, Domain
move_2 = Move(Geometry=intcrv_2.Curve, Motion=Y)  # -> Geometry, Transform
move_3 = Move(Geometry=intcrv.Curve, Motion=Y)  # -> Geometry, Transform
eval_2 = EvaluateCurve(Curve=reparameterize(move_3.Geometry), Parameter=graph)  # -> Point, Tangent, Angle
eval_3 = EvaluateCurve(Curve=reparameterize(move_2.Geometry), Parameter=graph)  # -> Point, Tangent, Angle
eval_4 = EvaluateCurve(Curve=reparameterize(intcrv.Curve), Parameter=graph)  # -> Point, Tangent, Angle
eval_5 = EvaluateCurve(Curve=reparameterize(intcrv_2.Curve), Parameter=graph)  # -> Point, Tangent, Angle
cull = CullPattern(List=eval_3.Point, CullPattern=invert([True, False]))
cull_2 = CullPattern(List=eval_4.Point, CullPattern=invert([True, False]))
cull_3 = CullPattern(List=eval_2.Point, CullPattern=[True, False])
cull_4 = CullPattern(List=eval_5.Point, CullPattern=[True, False])
weave = Weave(Pattern=[0, 1], Stream0=cull_3, Stream1=cull, NullGaps=False)
weave_2 = Weave(Pattern=[0, 1], Stream0=cull_4, Stream1=cull_2, NullGaps=False)
pline = PolyLine(Vertices=weave, Closed=False)
pline_2 = PolyLine(Vertices=weave_2, Closed=False)
explode = Explode(Curve=pline, Recursive=True)  # -> Segments, Vertices
explode_2 = Explode(Curve=pline_2, Recursive=True)  # -> Segments, Vertices
number_slider_3 = Slider(0, range=0..1)
number_slider_4 = Slider(1, range=0..1)
eval_6 = EvaluateLength(Curve=reparameterize(graft(explode.Segments)), Length=[number_slider_3, number_slider_4], Normalized=True)  # -> Point, Tangent, Parameter
eval_7 = EvaluateLength(Curve=reparameterize(graft(explode_2.Segments)), Length=[number_slider_3, number_slider_4], Normalized=True)  # -> Point, Tangent, Parameter
item = ListItem(List=eval_6.Point, Index="0", Wrap=True)
item_2 = ListItem(List=eval_6.Point, Index="1", Wrap=True)
item_3 = ListItem(List=eval_7.Point, Index="1", Wrap=True)
item_4 = ListItem(List=eval_7.Point, Index="0", Wrap=True)
merge_2 = Merge(Data1=item_4, Data2=item_3, Data3=item)
merge_3 = Merge(Data1=item_2, Data2=item_3, Data3=item)
pline_3 = PolyLine(Vertices=merge_2, Closed=True)
pline_4 = PolyLine(Vertices=merge_3, Closed=True)
srf = Surface(pline_4)
srf_2 = Surface(pline_3)
merge_4 = Merge(Data1=srf_2, Data2=srf)  # -> flatten(Result)
xz = XZPlane(Origin=Point(0, 0, 0))
join = BrepJoin(Breps=merge_4)  # -> Breps, Closed
mirror = Mirror(Geometry=join.Breps, Plane=PlaneYZ(0, 0, 0))  # -> Geometry, Transform
mirror_2 = Mirror(Geometry=mirror.Geometry, Plane=xz)  # -> Geometry, Transform
mirror_3 = Mirror(Geometry=join.Breps, Plane=xz)  # -> Geometry, Transform
merge_5 = Merge(Data1=join.Breps, Data2=mirror.Geometry, Data3=mirror_2.Geometry, Data4=mirror_3.Geometry)
multiplication = Multiplication(A=number_slider_2, B=2)
join_2 = BrepJoin(Breps=merge_5)  # -> Breps, Closed
series = Series(Start=0, Step=multiplication, Count=10)
Y_2 = UnitY(Factor=series)
move_4 = Move(Geometry=join_2.Breps, Motion=Y_2)  # -> Geometry, Transform
