# Grasshopper definition zaliczenie lattice hinges 01.gh (Grasshopper 0.9.76)

gestosc_linii_poziom = Slider(4, range=0..10)
gestosc_linii_pion = Slider(70, range=5..70)
gestosc_linii_poziom_2 = Slider(5, range=0..10)
gestosc_linii_poziom_3 = Slider(5, range=0..10)
crv_ksztalt_bok_1 = Curve(<curve referenced from the Rhino model>)
gestosc_linii_pion_2 = Slider(35, range=5..35)
gestosc_linii_pion_3 = Slider(35, range=5..35)
crv_pion_2 = Curve(<curve referenced from the Rhino model>)
crv_pion_1 = Curve(<curve referenced from the Rhino model>)
gestosc_linii_poziom_4 = Slider(4, range=0..10)
crv_ksztalt_bok_1_2 = Curve(<curve referenced from the Rhino model>)
crv_ksztalt_bok_1_3 = Curve(<curve referenced from the Rhino model>)
gestosc_linii_pion_4 = Slider(50, range=5..70)
crv_pion_2_2 = Curve(<curve referenced from the Rhino model>)
crv_pion_1_2 = Curve(<curve referenced from the Rhino model>)
crv_pion_2_3 = Curve(<curve referenced from the Rhino model>)
crv_pion_1_3 = Curve(<curve referenced from the Rhino model>)
crv_ksztalt_bok_1_4 = Curve(<curve referenced from the Rhino model>)
gestosc_linii_poziom_5 = Slider(5, range=0..10)
crv_pion_2_4 = Curve(<curve referenced from the Rhino model>)
gestosc_linii_pion_5 = Slider(35, range=5..35)
crv_pion_1_4 = Curve(<curve referenced from the Rhino model>)
crv_ksztalt_bok_1_5 = Curve(<curve referenced from the Rhino model>)
crv_pion_2_5 = Curve(<curve referenced from the Rhino model>)
crv_pion_1_5 = Curve(<curve referenced from the Rhino model>)
curvepoint = PointOnCurve(crv_pion_1, parameter=0)
curvepoint_2 = PointOnCurve(crv_pion_2, parameter=0)
curvepoint_3 = PointOnCurve(crv_pion_1_2, parameter=0)
curvepoint_4 = PointOnCurve(crv_pion_2_2, parameter=0)
curvepoint_5 = PointOnCurve(crv_pion_1_3, parameter=0)
curvepoint_6 = PointOnCurve(crv_pion_2_3, parameter=0)
curvepoint_7 = PointOnCurve(crv_pion_1_4, parameter=0)
curvepoint_8 = PointOnCurve(crv_pion_2_4, parameter=0)
curvepoint_9 = PointOnCurve(crv_pion_1_5, parameter=0)
curvepoint_10 = PointOnCurve(crv_pion_2_5, parameter=0)
ln = Line(StartPoint=curvepoint, EndPoint=curvepoint_2)
ln_2 = Line(StartPoint=curvepoint_3, EndPoint=curvepoint_4)
ln_3 = Line(StartPoint=curvepoint_5, EndPoint=curvepoint_6)
ln_4 = Line(StartPoint=curvepoint_7, EndPoint=curvepoint_8)
ln_5 = Line(StartPoint=curvepoint_9, EndPoint=curvepoint_10)
pframe = PerpFrame(Curve=reparameterize(ln), Parameter="0.5")
mirror = Mirror(Geometry=crv_ksztalt_bok_1, Plane=pframe)  # -> Geometry, Transform
divide = DivideCurve(Curve=mirror.Geometry, Count=gestosc_linii_pion, Kinks=False)  # -> Points, Tangents, Parameters
divide_2 = DivideCurve(Curve=crv_ksztalt_bok_1, Count=gestosc_linii_pion, Kinks=False)  # -> Points, Tangents, Parameters
pframe_2 = PerpFrame(Curve=reparameterize(ln_2), Parameter="0.5")
mirror_2 = Mirror(Geometry=crv_ksztalt_bok_1_2, Plane=pframe_2)  # -> Geometry, Transform
pframe_3 = PerpFrame(Curve=reparameterize(ln_3), Parameter="0.5")
mirror_3 = Mirror(Geometry=crv_ksztalt_bok_1_3, Plane=pframe_3)  # -> Geometry, Transform
divide_3 = DivideCurve(Curve=reparameterize(mirror_3.Geometry), Count=gestosc_linii_pion_3, Kinks=False)  # -> Points, Tangents, Parameters
divide_4 = DivideCurve(Curve=reparameterize(crv_ksztalt_bok_1_3), Count=gestosc_linii_pion_3, Kinks=False)  # -> Points, Tangents, Parameters
divide_5 = DivideCurve(Curve=mirror_2.Geometry, Count=gestosc_linii_pion_2, Kinks=False)  # -> Points, Tangents, Parameters
divide_6 = DivideCurve(Curve=crv_ksztalt_bok_1_2, Count=gestosc_linii_pion_2, Kinks=False)  # -> Points, Tangents, Parameters
pframe_4 = PerpFrame(Curve=reparameterize(ln_4), Parameter="0.5")
mirror_4 = Mirror(Geometry=crv_ksztalt_bok_1_4, Plane=pframe_4)  # -> Geometry, Transform
divide_7 = DivideCurve(Curve=mirror_4.Geometry, Count=gestosc_linii_pion_4, Kinks=False)  # -> Points, Tangents, Parameters
divide_8 = DivideCurve(Curve=crv_ksztalt_bok_1_4, Count=gestosc_linii_pion_4, Kinks=False)  # -> Points, Tangents, Parameters
pframe_5 = PerpFrame(Curve=reparameterize(ln_5), Parameter="0.5")
mirror_5 = Mirror(Geometry=crv_ksztalt_bok_1_5, Plane=pframe_5)  # -> Geometry, Transform
divide_9 = DivideCurve(Curve=mirror_5.Geometry, Count=gestosc_linii_pion_5, Kinks=False)  # -> Points, Tangents, Parameters
divide_10 = DivideCurve(Curve=crv_ksztalt_bok_1_5, Count=gestosc_linii_pion_5, Kinks=False)  # -> Points, Tangents, Parameters
graph = GraphMapper(
    divide_4.Parameters,
    x0=0,
    x1=1,
    y0=0,
    y1=1,
    container_name="Bezier",
    cpx=[0, 0.4900968373, 0.5144113898, 1],
    cpy=[0, 0.1705463529, 0.6902740002, 1])
eval = EvaluateCurve(Curve=reparameterize(mirror_3.Geometry), Parameter=graph)  # -> Point, Tangent, Angle
eval_2 = EvaluateCurve(Curve=reparameterize(crv_ksztalt_bok_1_3), Parameter=graph)  # -> Point, Tangent, Angle
multiplication = Multiplication(A=gestosc_linii_poziom, B="4")

lng = ListLength(List=divide_2.Points)
series = Series(Start="1", Step="2", Count=expr("x/2", lng))
item = ListItem(List=divide_2.Points, Index=series, Wrap=False)
item_2 = ListItem(List=divide.Points, Index=series, Wrap=False)
ln_6 = Line(StartPoint=item, EndPoint=item_2)
divide_11 = DivideCurve(Curve=reparameterize(ln_6), Count=expr("x+1", multiplication), Kinks=False)  # -> Points, Tangents, Parameters
shatter = Shatter(Curve=reparameterize(ln_6), Parameters=divide_11.Parameters)
cull = CullPattern(List=shatter, CullPattern=[True, True, False, True])

lng_2 = ListLength(List=divide_2.Points)
series_2 = Series(Start="0", Step="2", Count=expr("x/2", lng_2))
item_3 = ListItem(List=divide_2.Points, Index=series_2, Wrap=False)
item_4 = ListItem(List=divide.Points, Index=series_2, Wrap=False)
ln_7 = Line(StartPoint=item_3, EndPoint=item_4)
divide_12 = DivideCurve(Curve=reparameterize(ln_7), Count=expr("x+1", multiplication), Kinks=False)  # -> Points, Tangents, Parameters
shatter_2 = Shatter(Curve=reparameterize(ln_7), Parameters=divide_12.Parameters)
cull_2 = CullPattern(List=shatter_2, CullPattern=[False, True, True, True])

multiplication_2 = Multiplication(A=gestosc_linii_poziom_2, B="4")

lng_3 = ListLength(List=divide_6.Points)
series_3 = Series(Start="1", Step="2", Count=expr("x/2", lng_3))
item_5 = ListItem(List=divide_6.Points, Index=series_3, Wrap=False)
item_6 = ListItem(List=divide_5.Points, Index=series_3, Wrap=False)
ln_8 = Line(StartPoint=item_5, EndPoint=item_6)
divide_13 = DivideCurve(Curve=reparameterize(ln_8), Count=expr("x+1", multiplication_2), Kinks=False)  # -> Points, Tangents, Parameters
shatter_3 = Shatter(Curve=reparameterize(ln_8), Parameters=divide_13.Parameters)
cull_3 = CullPattern(List=shatter_3, CullPattern=[True, True, False, True])

lng_4 = ListLength(List=divide_6.Points)
series_4 = Series(Start="0", Step="2", Count=expr("x/2", lng_4))
item_7 = ListItem(List=divide_6.Points, Index=series_4, Wrap=False)
item_8 = ListItem(List=divide_5.Points, Index=series_4, Wrap=False)
ln_9 = Line(StartPoint=item_7, EndPoint=item_8)
divide_14 = DivideCurve(Curve=reparameterize(ln_9), Count=expr("x+1", multiplication_2), Kinks=False)  # -> Points, Tangents, Parameters
shatter_4 = Shatter(Curve=reparameterize(ln_9), Parameters=divide_14.Parameters)
cull_4 = CullPattern(List=shatter_4, CullPattern=[False, True, True, True])

multiplication_3 = Multiplication(A=gestosc_linii_poziom_4, B="4")

lng_5 = ListLength(List=divide_8.Points)
series_5 = Series(Start="1", Step="2", Count=expr("x/2", lng_5))
item_9 = ListItem(List=divide_8.Points, Index=series_5, Wrap=False)
item_10 = ListItem(List=divide_7.Points, Index=series_5, Wrap=False)
ln_10 = Line(StartPoint=item_9, EndPoint=item_10)
divide_15 = DivideCurve(Curve=reparameterize(ln_10), Count=expr("x+1", multiplication_3), Kinks=False)  # -> Points, Tangents, Parameters
shatter_5 = Shatter(Curve=reparameterize(ln_10), Parameters=divide_15.Parameters)
cull_5 = CullPattern(List=shatter_5, CullPattern=[True, True, False, True])

lng_6 = ListLength(List=divide_8.Points)
series_6 = Series(Start="0", Step="2", Count=expr("x/2", lng_6))
item_11 = ListItem(List=divide_8.Points, Index=series_6, Wrap=False)
item_12 = ListItem(List=divide_7.Points, Index=series_6, Wrap=False)
ln_11 = Line(StartPoint=item_11, EndPoint=item_12)
divide_16 = DivideCurve(Curve=reparameterize(ln_11), Count=expr("x+1", multiplication_3), Kinks=False)  # -> Points, Tangents, Parameters
shatter_6 = Shatter(Curve=reparameterize(ln_11), Parameters=divide_16.Parameters)
cull_6 = CullPattern(List=shatter_6, CullPattern=[False, True, True, True])

multiplication_4 = Multiplication(A=gestosc_linii_poziom_5, B="4")

lng_7 = ListLength(List=divide_10.Points)
series_7 = Series(Start="1", Step="2", Count=expr("x/2", lng_7))
item_13 = ListItem(List=divide_10.Points, Index=series_7, Wrap=False)
item_14 = ListItem(List=divide_9.Points, Index=series_7, Wrap=False)
ln_12 = Line(StartPoint=item_13, EndPoint=item_14)
divide_17 = DivideCurve(Curve=reparameterize(ln_12), Count=expr("x+1", multiplication_4), Kinks=False)  # -> Points, Tangents, Parameters
shatter_7 = Shatter(Curve=reparameterize(ln_12), Parameters=divide_17.Parameters)
cull_7 = CullPattern(List=shatter_7, CullPattern=[True, True, False, True])

lng_8 = ListLength(List=divide_10.Points)
series_8 = Series(Start="0", Step="2", Count=expr("x/2", lng_8))
item_15 = ListItem(List=divide_10.Points, Index=series_8, Wrap=False)
item_16 = ListItem(List=divide_9.Points, Index=series_8, Wrap=False)
ln_13 = Line(StartPoint=item_15, EndPoint=item_16)
divide_18 = DivideCurve(Curve=reparameterize(ln_13), Count=expr("x+1", multiplication_4), Kinks=False)  # -> Points, Tangents, Parameters
shatter_8 = Shatter(Curve=reparameterize(ln_13), Parameters=divide_18.Parameters)
cull_8 = CullPattern(List=shatter_8, CullPattern=[False, True, True, True])

multiplication_5 = Multiplication(A=gestosc_linii_poziom_3, B="4")

lng_9 = ListLength(List=eval_2.Point)
series_9 = Series(Start="1", Step="2", Count=expr("x/2", lng_9))
item_17 = ListItem(List=eval_2.Point, Index=series_9, Wrap=False)
item_18 = ListItem(List=eval.Point, Index=series_9, Wrap=False)
ln_14 = Line(StartPoint=item_17, EndPoint=item_18)
divide_19 = DivideCurve(Curve=reparameterize(ln_14), Count=expr("x+1", multiplication_5), Kinks=False)  # -> Points, Tangents, Parameters
shatter_9 = Shatter(Curve=reparameterize(ln_14), Parameters=divide_19.Parameters)
cull_9 = CullPattern(List=shatter_9, CullPattern=[True, True, False, True])

lng_10 = ListLength(List=eval_2.Point)
series_10 = Series(Start="0", Step="2", Count=expr("x/2", lng_10))
item_19 = ListItem(List=eval_2.Point, Index=series_10, Wrap=False)
item_20 = ListItem(List=eval.Point, Index=series_10, Wrap=False)
ln_15 = Line(StartPoint=item_19, EndPoint=item_20)
divide_20 = DivideCurve(Curve=reparameterize(ln_15), Count=expr("x+1", multiplication_5), Kinks=False)  # -> Points, Tangents, Parameters
shatter_10 = Shatter(Curve=reparameterize(ln_15), Parameters=divide_20.Parameters)
cull_10 = CullPattern(List=shatter_10, CullPattern=[False, True, True, True])

crv = Curve(cull)
crv_2 = Curve(cull_2)

crv_3 = Curve(cull_6)
join = JoinCurves(Curves=crv_3, Preserve=False)
eval_3 = EvaluateCurve(Curve=reparameterize(join), Parameter="0.5")  # -> Point, Tangent, Angle
curvepoint_11 = PointOnCurve(join, parameter=0)
curvepoint_12 = PointOnCurve(join, parameter=1)
number_slider = Slider(0.3, range=0..1)
number_slider_2 = Slider(19, range=0..30)
len = Length(Curve=join)
unit = UnitVector(Vector=eval_3.Tangent)
division = Division(A=len, B=number_slider_2)
line = LineSDL(Start=eval_3.Point, Direction=unit, Length=division)
multiplication_6 = Multiplication(A=number_slider_2, B=Slider(0.3, range=0..1))
rotate = Rotate(Geometry=line, Angle=expr("-x", 1.570796327), Plane=eval_3.Point)  # -> Geometry, Transform
rotate_2 = Rotate(Geometry=line, Angle=1.570796327, Plane=eval_3.Point)  # -> Geometry, Transform
curvepoint_13 = PointOnCurve(rotate_2.Geometry, parameter=1)
curvepoint_14 = PointOnCurve(rotate.Geometry, parameter=1)
curvepoint_15 = PointOnCurve(join, parameter=0.75)
curvepoint_16 = PointOnCurve(rotate_2.Geometry, parameter=0)
curvepoint_17 = PointOnCurve(join, parameter=0.25)
curvepoint_18 = PointOnCurve(rotate_2.Geometry, parameter=0)
vec2pt = Vector2Pt(PointA=curvepoint_16, PointB=curvepoint_15, Unitize=False)  # -> Vector, Length
vec2pt_2 = Vector2Pt(PointA=curvepoint_18, PointB=curvepoint_17, Unitize=False)  # -> Vector, Length
move = Move(Geometry=rotate_2.Geometry, Motion=vec2pt.Vector)  # -> Geometry, Transform
move_2 = Move(Geometry=rotate_2.Geometry, Motion=vec2pt_2.Vector)  # -> Geometry, Transform
scale_nu = ScaleNU(Geometry=move.Geometry, Plane=curvepoint_15, ScaleX=1, ScaleY=number_slider, ScaleZ=1)  # -> Geometry, Transform
xz = XZPlane(Origin=curvepoint_15)
scale_nu_2 = ScaleNU(Geometry=move_2.Geometry, Plane=curvepoint_17, ScaleX=1, ScaleY=number_slider, ScaleZ=1)  # -> Geometry, Transform
xz_2 = XZPlane(Origin=curvepoint_17)
curvepoint_19 = PointOnCurve(scale_nu.Geometry, parameter=1)
curvepoint_20 = PointOnCurve(scale_nu_2.Geometry, parameter=1)
mirror_6 = Mirror(Geometry=curvepoint_19, Plane=xz)  # -> Geometry, Transform
mirror_7 = Mirror(Geometry=curvepoint_20, Plane=xz_2)  # -> Geometry, Transform
simplify = SimplifyTree(Tree=curvepoint_20, Front=False)  # -> graft(Tree)
simplify_2 = SimplifyTree(Tree=curvepoint_19, Front=False)  # -> graft(Tree)
simplify_3 = SimplifyTree(Tree=curvepoint_11, Front=False)  # -> graft(Tree)
simplify_4 = SimplifyTree(Tree=mirror_7.Geometry, Front=False)  # -> graft(Tree)
simplify_5 = SimplifyTree(Tree=mirror_6.Geometry, Front=False)  # -> graft(Tree)
simplify_6 = SimplifyTree(Tree=curvepoint_13, Front=False)  # -> graft(Tree)
simplify_7 = SimplifyTree(Tree=curvepoint_12, Front=False)  # -> graft(Tree)
simplify_8 = SimplifyTree(Tree=curvepoint_14, Front=False)  # -> graft(Tree)
merge = Merge(
    Data1=simplify_3,
    Data2=simplify,
    Data3=simplify_6,
    Data4=simplify_2,
    Data5=simplify_7,
    Data6=simplify_5,
    Data7=simplify_8,
    Data8=simplify_4)
intcrv = Interpolate(Vertices=merge, Degree=3, Periodic=True, KnotStyle=1)  # -> Curve, Length, Domain

crv_4 = Curve(cull_5)
join_2 = JoinCurves(Curves=crv_4, Preserve=False)
eval_4 = EvaluateCurve(Curve=reparameterize(join_2), Parameter="0.5")  # -> Point, Tangent, Angle
curvepoint_21 = PointOnCurve(join_2, parameter=0)
curvepoint_22 = PointOnCurve(join_2, parameter=1)
number_slider_3 = Slider(0.3, range=0..1)
number_slider_4 = Slider(19, range=0..30)
len_2 = Length(Curve=join_2)
unit_2 = UnitVector(Vector=eval_4.Tangent)
division_2 = Division(A=len_2, B=number_slider_4)
line_2 = LineSDL(Start=eval_4.Point, Direction=unit_2, Length=division_2)
multiplication_7 = Multiplication(A=number_slider_4, B=Slider(0.3, range=0..1))
rotate_3 = Rotate(Geometry=line_2, Angle=expr("-x", 1.570796327), Plane=eval_4.Point)  # -> Geometry, Transform
rotate_4 = Rotate(Geometry=line_2, Angle=1.570796327, Plane=eval_4.Point)  # -> Geometry, Transform
curvepoint_23 = PointOnCurve(rotate_4.Geometry, parameter=1)
curvepoint_24 = PointOnCurve(rotate_3.Geometry, parameter=1)
curvepoint_25 = PointOnCurve(join_2, parameter=0.75)
curvepoint_26 = PointOnCurve(rotate_4.Geometry, parameter=0)
curvepoint_27 = PointOnCurve(join_2, parameter=0.25)
curvepoint_28 = PointOnCurve(rotate_4.Geometry, parameter=0)
vec2pt_3 = Vector2Pt(PointA=curvepoint_26, PointB=curvepoint_25, Unitize=False)  # -> Vector, Length
vec2pt_4 = Vector2Pt(PointA=curvepoint_28, PointB=curvepoint_27, Unitize=False)  # -> Vector, Length
move_3 = Move(Geometry=rotate_4.Geometry, Motion=vec2pt_3.Vector)  # -> Geometry, Transform
move_4 = Move(Geometry=rotate_4.Geometry, Motion=vec2pt_4.Vector)  # -> Geometry, Transform
scale_nu_3 = ScaleNU(Geometry=move_3.Geometry, Plane=curvepoint_25, ScaleX=1, ScaleY=number_slider_3, ScaleZ=1)  # -> Geometry, Transform
xz_3 = XZPlane(Origin=curvepoint_25)
scale_nu_4 = ScaleNU(Geometry=move_4.Geometry, Plane=curvepoint_27, ScaleX=1, ScaleY=number_slider_3, ScaleZ=1)  # -> Geometry, Transform
xz_4 = XZPlane(Origin=curvepoint_27)
curvepoint_29 = PointOnCurve(scale_nu_3.Geometry, parameter=1)
curvepoint_30 = PointOnCurve(scale_nu_4.Geometry, parameter=1)
mirror_8 = Mirror(Geometry=curvepoint_29, Plane=xz_3)  # -> Geometry, Transform
mirror_9 = Mirror(Geometry=curvepoint_30, Plane=xz_4)  # -> Geometry, Transform
simplify_9 = SimplifyTree(Tree=curvepoint_30, Front=False)  # -> graft(Tree)
simplify_10 = SimplifyTree(Tree=curvepoint_29, Front=False)  # -> graft(Tree)
simplify_11 = SimplifyTree(Tree=curvepoint_21, Front=False)  # -> graft(Tree)
simplify_12 = SimplifyTree(Tree=mirror_9.Geometry, Front=False)  # -> graft(Tree)
simplify_13 = SimplifyTree(Tree=mirror_8.Geometry, Front=False)  # -> graft(Tree)
simplify_14 = SimplifyTree(Tree=curvepoint_23, Front=False)  # -> graft(Tree)
simplify_15 = SimplifyTree(Tree=curvepoint_22, Front=False)  # -> graft(Tree)
simplify_16 = SimplifyTree(Tree=curvepoint_24, Front=False)  # -> graft(Tree)
merge_2 = Merge(
    Data1=simplify_11,
    Data2=simplify_9,
    Data3=simplify_14,
    Data4=simplify_10,
    Data5=simplify_15,
    Data6=simplify_13,
    Data7=simplify_16,
    Data8=simplify_12)
intcrv_2 = Interpolate(Vertices=merge_2, Degree=3, Periodic=True, KnotStyle=1)  # -> Curve, Length, Domain

number_slider_5 = Slider(19, range=0..30)

join_3 = JoinCurves(Curves=crv, Preserve=False)
eval_5 = EvaluateCurve(Curve=reparameterize(join_3), Parameter="0.5")  # -> Point, Tangent, Angle
curvepoint_31 = PointOnCurve(join_3, parameter=0)
curvepoint_32 = PointOnCurve(join_3, parameter=1)
len_3 = Length(Curve=join_3)
unit_3 = UnitVector(Vector=eval_5.Tangent)
division_3 = Division(A=len_3, B=number_slider_5)
line_3 = LineSDL(Start=eval_5.Point, Direction=unit_3, Length=division_3)
rotate_5 = Rotate(Geometry=line_3, Angle=expr("-x", 1.570796327), Plane=eval_5.Point)  # -> Geometry, Transform
rotate_6 = Rotate(Geometry=line_3, Angle=1.570796327, Plane=eval_5.Point)  # -> Geometry, Transform
curvepoint_33 = PointOnCurve(rotate_6.Geometry, parameter=1)
curvepoint_34 = PointOnCurve(rotate_5.Geometry, parameter=1)
merge_3 = Merge(Data1=graft(curvepoint_31), Data2=graft(curvepoint_33), Data3=graft(curvepoint_32), Data4=graft(curvepoint_34))
pline = PolyLine(Vertices=merge_3, Closed=True)

join_4 = JoinCurves(Curves=crv_2, Preserve=False)
eval_6 = EvaluateCurve(Curve=reparameterize(join_4), Parameter="0.5")  # -> Point, Tangent, Angle
curvepoint_35 = PointOnCurve(join_4, parameter=0)
curvepoint_36 = PointOnCurve(join_4, parameter=1)
len_4 = Length(Curve=join_4)
unit_4 = UnitVector(Vector=eval_6.Tangent)
division_4 = Division(A=len_4, B=number_slider_5)
line_4 = LineSDL(Start=eval_6.Point, Direction=unit_4, Length=division_4)
rotate_7 = Rotate(Geometry=line_4, Angle=expr("-x", 1.570796327), Plane=eval_6.Point)  # -> Geometry, Transform
rotate_8 = Rotate(Geometry=line_4, Angle=1.570796327, Plane=eval_6.Point)  # -> Geometry, Transform
curvepoint_37 = PointOnCurve(rotate_8.Geometry, parameter=1)
curvepoint_38 = PointOnCurve(rotate_7.Geometry, parameter=1)
merge_4 = Merge(Data1=graft(curvepoint_35), Data2=graft(curvepoint_37), Data3=graft(curvepoint_36), Data4=graft(curvepoint_38))
pline_2 = PolyLine(Vertices=merge_4, Closed=True)

# ----
# kerf 4
srf_ksztalt_docelowy = Surface(<surface referenced from the Rhino model>)
srf_baza = Surface(<surface referenced from the Rhino model>)
crv_baza = Curve([<curve referenced from the Rhino model> x223])
divide_21 = DivideCurve(Curve=crv_baza, Count=Slider(20, range=0..40), Kinks=False)  # -> Points, Tangents, Parameters
srf_cp = SurfaceClosestPoint(Point=divide_21.Points, Surface=reparameterize(srf_baza))  # -> Point, UVPoint, Distance
evalsrf = EvaluateSurface(Surface=reparameterize(srf_ksztalt_docelowy), Point=srf_cp.UVPoint)  # -> Point, Normal, Frame
intcrv_3 = Interpolate(Vertices=evalsrf.Point, Degree=3, Periodic=False, KnotStyle=1)  # -> Curve, Length, Domain

# ----
# kerf 7
srf_ksztalt_docelowy_2 = Surface(<surface referenced from the Rhino model>)
srf_baza_2 = Surface(<surface referenced from the Rhino model>)
crv_baza_2 = Curve([<curve referenced from the Rhino model> x161])
divide_22 = DivideCurve(Curve=crv_baza_2, Count=Slider(40, range=0..40), Kinks=False)  # -> Points, Tangents, Parameters
srf_cp_2 = SurfaceClosestPoint(Point=divide_22.Points, Surface=reparameterize(srf_baza_2))  # -> Point, UVPoint, Distance
evalsrf_2 = EvaluateSurface(Surface=reparameterize(srf_ksztalt_docelowy_2), Point=srf_cp_2.UVPoint)  # -> Point, Normal, Frame
intcrv_4 = Interpolate(Vertices=evalsrf_2.Point, Degree=3, Periodic=True, KnotStyle=1)  # -> Curve, Length, Domain

# ----
# kerf 5
srf_ksztalt_docelowy_3 = Surface(<surface referenced from the Rhino model>)
srf_baza_3 = Surface(<surface referenced from the Rhino model>)
crv_baza_3 = Curve([<curve referenced from the Rhino model> x765])
divide_23 = DivideCurve(Curve=crv_baza_3, Count=Slider(20, range=0..40), Kinks=False)  # -> Points, Tangents, Parameters
srf_cp_3 = SurfaceClosestPoint(Point=divide_23.Points, Surface=reparameterize(srf_baza_3))  # -> Point, UVPoint, Distance
evalsrf_3 = EvaluateSurface(Surface=reparameterize(srf_ksztalt_docelowy_3), Point=srf_cp_3.UVPoint)  # -> Point, Normal, Frame
intcrv_5 = Interpolate(Vertices=evalsrf_3.Point, Degree=3, Periodic=False, KnotStyle=1)  # -> Curve, Length, Domain

# ----
# kerf 6
srf_ksztalt_docelowy_4 = Surface(<surface referenced from the Rhino model>)
srf_baza_4 = Surface(<surface referenced from the Rhino model>)
crv_baza_4 = Curve([<curve referenced from the Rhino model> x142])
divide_24 = DivideCurve(Curve=crv_baza_4, Count=Slider(40, range=0..40), Kinks=False)  # -> Points, Tangents, Parameters
srf_cp_4 = SurfaceClosestPoint(Point=divide_24.Points, Surface=reparameterize(srf_baza_4))  # -> Point, UVPoint, Distance
evalsrf_4 = EvaluateSurface(Surface=reparameterize(srf_ksztalt_docelowy_4), Point=srf_cp_4.UVPoint)  # -> Point, Normal, Frame
intcrv_6 = Interpolate(Vertices=evalsrf_4.Point, Degree=3, Periodic=True, KnotStyle=1)  # -> Curve, Length, Domain

# ----
# kerf 8
srf_ksztalt_docelowy_5 = Surface(<surface referenced from the Rhino model>)
srf_baza_5 = Surface(<surface referenced from the Rhino model>)
crv_baza_5 = Curve([<curve referenced from the Rhino model> x270])
explode = Explode(Curve=crv_baza_5, Recursive=True)  # -> Segments, Vertices
srf_cp_5 = SurfaceClosestPoint(Point=explode.Vertices, Surface=reparameterize(srf_baza_5))  # -> Point, UVPoint, Distance
evalsrf_5 = EvaluateSurface(Surface=reparameterize(srf_ksztalt_docelowy_5), Point=srf_cp_5.UVPoint)  # -> Point, Normal, Frame
pline_3 = PolyLine(Vertices=evalsrf_5.Point, Closed=False)

# ----
# kerf 9
srf_ksztalt_docelowy_6 = Surface(<surface referenced from the Rhino model>)
srf_baza_6 = Surface(<surface referenced from the Rhino model>)
crv_baza_6 = Curve([<curve referenced from the Rhino model> x560])
divide_25 = DivideCurve(Curve=crv_baza_6, Count=Slider(20, range=0..40), Kinks=False)  # -> Points, Tangents, Parameters

explode_2 = Explode(Curve=crv_baza_6, Recursive=True)  # -> Segments, Vertices

srf_cp_6 = SurfaceClosestPoint(Point=explode_2.Vertices, Surface=reparameterize(srf_baza_6))  # -> Point, UVPoint, Distance
evalsrf_6 = EvaluateSurface(Surface=reparameterize(srf_ksztalt_docelowy_6), Point=srf_cp_6.UVPoint)  # -> Point, Normal, Frame

pline_4 = PolyLine(Vertices=evalsrf_6.Point, Closed=False)
