# Grasshopper definition zaliecznie projekt bowerbird 02 z weaverbird smooth OK.gh (Grasshopper 0.9.76)
# plug-ins: Weaverbird, Bowerbird

# ----
# zadanie: przypisanie innego bazowego ksztaltu oprocz szescianu
otwarcie_rozmiar_polowa = Slider(28, range=0..100)
box_rozmiar_polowa = Slider(50, range=0..100)
multiplication = Multiplication(A=otwarcie_rozmiar_polowa, B="2")
multiplication_2 = Multiplication(A=box_rozmiar_polowa, B="2")
subtraction = Subtraction(A=box_rozmiar_polowa, B=otwarcie_rozmiar_polowa)
panel = Panel([multiplication_2, multiplication])
box = CenterBox(Base=PlaneXY(0, 0, 0), X=subtraction, Y=subtraction, Z=expr("x*2", box_rozmiar_polowa))
box_2 = CenterBox(Base=PlaneXY(0, 0, 0), X=expr("x*2", box_rozmiar_polowa), Y=subtraction, Z=subtraction)
box_3 = CenterBox(Base=PlaneXY(0, 0, 0), X=subtraction, Y=expr("x*2", box_rozmiar_polowa), Z=subtraction)
box_4 = CenterBox(Base=PlaneXY(0, 0, 0), X=box_rozmiar_polowa, Y=box_rozmiar_polowa, Z=box_rozmiar_polowa)
sdiff = SolidDifference(FirstSet=box_4, SecondSet=[box, box_2, box_3])

custom_mesh_settings = SettingsCustom(
    StitchSeams=True,
    SimplePlanes=True,
    Refine=True,
    MinCount=1,
    MaxCount=2,
    AspectRatio=20,
    MaxDistance=0,
    MaxAngle=20,
    MinEdge=0,
    MaxEdge=0)
mesh = MeshBrep(BRep=sdiff, Settings=custom_mesh_settings)
wbcatmullclark = WeaverBirdSCatmullClarkSubdivision(Mesh=mesh, Level=3, SmoothNakedEdges=1)  # disabled
xy = XYPlane(Origin=Point(0, 0, 0))
Z = UnitZ(Factor=1)
Y = UnitY(Factor=1)
X = UnitX(Factor=1)
rot3d = Rotate3D(Geometry=xy, Angle=degrees(Slider(45, range=-90..90)), Center=xy, Axis=Z)  # -> Geometry, Transform
rot3d_2 = Rotate3D(Geometry=rot3d.Geometry, Angle=degrees(Slider(-45, range=-90..90)), Center=xy, Axis=X)  # -> Geometry, Transform
bbwaffle = BBWaffle(
    Mesh=mesh,
    DivisionX=Slider(7, range=0..10),
    DivisionY=Slider(7, range=0..10),
    Thickness=Slider(3, range=0..10),
    Plane=rot3d_2.Geometry,
    Deeper=Slider(0, range=0..10),
    Project=False,
    Distance=1)  # -> SlicesU, SlicesV, SectionPlanesU, SectionPlanesV
srf = Surface(bbwaffle.SlicesV)
srf_2 = Surface(bbwaffle.SlicesU)
simplify = SimplifyTree(Tree=srf_2, Front=False)
simplify_2 = SimplifyTree(Tree=srf, Front=False)
branch = TreeBranch(Tree=simplify_2, Path="{1}", MaintainPaths=True)
branch_2 = TreeBranch(Tree=simplify, Path="{1}", MaintainPaths=True)

# ----
# bake 3d
pln_plaszczyzny_kierunek_u = Plane(bbwaffle.SectionPlanesU)
crv_przekroje_kierunek_u = Curve(bbwaffle.SlicesU)

lng = ListLength(List=flatten(pln_plaszczyzny_kierunek_u))
pt = ConstructPoint(XCoordinate=Slider(199, range=0..500), YCoordinate=0, ZCoordinate=0)
pdecon = Deconstruct(Point=pt)  # -> XComponent, YComponent, ZComponent
series = Series(Start=0, Step=Slider(350, range=0..500), Count=lng)
pt_2 = ConstructPoint(XCoordinate=pdecon.XComponent, YCoordinate=series, ZCoordinate=0)
xy_2 = XYPlane(Origin=graft(pt_2))
simplify_3 = SimplifyTree(Tree=xy_2, Front=False)
simplify_4 = SimplifyTree(Tree=pln_plaszczyzny_kierunek_u, Front=False)
simplify_5 = SimplifyTree(Tree=crv_przekroje_kierunek_u, Front=False)
orient = Orient(Geometry=simplify_5, Source=simplify_4, Target=simplify_3)  # -> Geometry, Transform
item = ListItem(List=orient.Geometry, Index=0, Wrap=True)
curvepoint = PointOnCurve(item, parameter=0.549)
xy_3 = XYPlane(Origin=flatten(curvepoint))
lng_2 = ListLength(List=xy_3)
series_2 = Series(Start=1, Step=1, Count=lng_2)
int = Integer(series_2)
concat = Concatenate(FragmentA="X", FragmentB=int)
bbtext = BBText(Location=xy_3, Text=concat, Size="10", Bold=False, HorizontalAlignment=0, VerticalAlignment=0)

# ----
# bake 3d
pln_plaszczyzny_kierunek_u_2 = Plane(bbwaffle.SectionPlanesV)
crv_przekroje_kierunek_u_2 = Curve(bbwaffle.SlicesV)

lng_3 = ListLength(List=flatten(pln_plaszczyzny_kierunek_u_2))
pt_3 = ConstructPoint(XCoordinate=Slider(685, range=0..700), YCoordinate=0, ZCoordinate=0)
pdecon_2 = Deconstruct(Point=pt_3)  # -> XComponent, YComponent, ZComponent
series_3 = Series(Start=0, Step=Slider(350, range=0..500), Count=lng_3)
pt_4 = ConstructPoint(XCoordinate=pdecon_2.XComponent, YCoordinate=series_3, ZCoordinate=0)
xy_4 = XYPlane(Origin=graft(pt_4))
simplify_6 = SimplifyTree(Tree=xy_4, Front=False)
simplify_7 = SimplifyTree(Tree=pln_plaszczyzny_kierunek_u_2, Front=False)
simplify_8 = SimplifyTree(Tree=crv_przekroje_kierunek_u_2, Front=False)
orient_2 = Orient(Geometry=simplify_8, Source=simplify_7, Target=simplify_6)  # -> Geometry, Transform
item_2 = ListItem(List=orient_2.Geometry, Index=0, Wrap=True)
curvepoint_2 = PointOnCurve(item_2, parameter=0.549)
xy_5 = XYPlane(Origin=flatten(curvepoint_2))
lng_4 = ListLength(List=xy_5)
series_4 = Series(Start=1, Step=1, Count=lng_4)
int_2 = Integer(series_4)
concat_2 = Concatenate(FragmentA="X", FragmentB=int_2)
bbtext_2 = BBText(Location=xy_5, Text=concat_2, Size="10", Bold=False, HorizontalAlignment=0, VerticalAlignment=0)

series_5 = Series(Start=orient.Geometry, Step=Slider(0, range=0..3), Count=10)
item_3 = ListItem(List=orient.Geometry, Index=Slider(3, range=0..3), Wrap=False)
item_4 = ListItem(List=orient.Geometry, Index=Slider(2, range=0..3), Wrap=False)
item_5 = ListItem(List=orient.Geometry, Index=Slider(1, range=0..3), Wrap=False)
item_6 = ListItem(List=orient.Geometry, Index=Slider(0, range=0..3), Wrap=False)
panel_2 = Panel(item_5)
