# Grasshopper definition bowerbird 01.gh (Grasshopper 0.9.76)
# plug-ins: Bowerbird

wysokosc = Slider(8, range=-10..10)
crv_profile = Curve([<curve referenced from the Rhino model> x3])
loft = Loft(Curves=crv_profile, Options={Adjust=False, Closed=False, LoftEnds=0, LoftSimp=0, LoftType=0, Rebuild=10, Refit=0.01})
Z = UnitZ(Factor=wysokosc)
poglebienie_naciec = Slider(0, range=0..1)
grubosc_materialu = Slider(3, range=0..20)

# ----
# polysurface
# (polypowierzchnia)
# poprzez "offset"
srf = Surface(loft)
offset = Offset(Surface=srf, Distance=Z, Retrim=False)
loft_2 = Loft(Curves=[srf, offset], Options={Adjust=False, Closed=False, LoftEnds=0, LoftSimp=0, LoftType=0, Rebuild=10, Refit=0.01})
merge = Merge(Data1=srf, Data2=offset, Data3=loft_2)
join = BrepJoin(Breps=flatten(merge))  # -> Breps, Closed
mesh = MeshBrep(
    Brep=join.Breps,
    Settings={GridMaxCount=0, GridMinCount=16, JaggedSeams=False, MaxEdgeLength=0, MinEdgeLength=0.0001, MinTolerance=0, Refine=True, RefineAngle=0, RelativeTolerance=0.65, SimplePlanes=True, Tolerance=0})

number_slider = Slider(10, range=3..20)
number_slider_2 = Slider(10, range=3..20)
# polysurface
# (polypowierzchnia)
# poprzez "extrude"
extr = Extrude(Base=loft, Direction=Z)
mesh_2 = MeshBrep(
    Brep=extr,
    Settings={GridMaxCount=0, GridMinCount=16, JaggedSeams=False, MaxEdgeLength=0, MinEdgeLength=0.0001, MinTolerance=0, Refine=True, RefineAngle=0, RelativeTolerance=0.65, SimplePlanes=True, Tolerance=0})
bbwaffle = BBWaffle(
    Mesh=mesh_2,
    CountX=number_slider,
    CountY=number_slider_2,
    Thickness=grubosc_materialu,
    Plane=PlaneXY(0, 0, 0),
    Deeper=poglebienie_naciec,
    Project=False,
    Distance=1)  # -> SlicesU, SlicesV, SectionPlanesU, SectionPlanesV
bbwaffle_2 = BBWaffle(
    Mesh=mesh_2,
    CountX=number_slider,
    CountY=number_slider_2,
    Thickness=grubosc_materialu,
    Plane=PlaneXY(0, 0, 0),
    Deeper=poglebienie_naciec,
    Project=Toggle(True),
    Distance=Slider(78, range=0..100))  # -> SlicesU, SlicesV, SectionPlanesU, SectionPlanesV

# ----
# bake curve 2d
crv_kierunek_v_2d = Curve(flatten(bbwaffle_2.SlicesV))
crv_kierunek_u_2d = Curve(flatten(bbwaffle_2.SlicesU))

# ----
# bake curve 3d
crv_kierunek_v_3d = Curve(flatten(bbwaffle.SlicesV))
crv_kierunek_u_3d = Curve(flatten(bbwaffle.SlicesU))

lng = ListLength(List=crv_kierunek_v_2d)
lng_2 = ListLength(List=crv_kierunek_u_2d)
area = Area(Geometry=crv_kierunek_v_2d)  # -> Area, Centroid
area_2 = Area(Geometry=crv_kierunek_u_2d)  # -> Area, Centroid
area_3 = Area(Geometry=flatten(crv_kierunek_u_3d))  # -> Area, Centroid
area_4 = Area(Geometry=flatten(crv_kierunek_v_3d))  # -> Area, Centroid
series = Series(Start="1", Step=1, Count=lng)
series_2 = Series(Start="1", Step=1, Count=lng_2)
text_size = Slider(3.3, range=0..10)
yz = YZPlane(Origin=flatten(area_3.Centroid))
xz = XZPlane(Origin=flatten(area_4.Centroid))
int = Integer(series_2)
int_2 = Integer(series)
concat = Concatenate(FragmentA="Y", FragmentB=int_2)
concat_2 = Concatenate(FragmentA="X", FragmentB=int)

# ----
# bake text 3d
bbtext = BBText(Location=yz, Text=concat_2, Size=text_size, Bold=False, HorizontalAlignment=0, VerticalAlignment=0)
bbtext_2 = BBText(Location=xz, Text=concat, Size=text_size, Bold=False, HorizontalAlignment=0, VerticalAlignment=0)

# ----
# bake text 2d
bbtext_3 = BBText(Location=area.Centroid, Text=concat, Size=text_size, Bold=False, HorizontalAlignment=0, VerticalAlignment=0)
bbtext_4 = BBText(Location=area_2.Centroid, Text=concat_2, Size=text_size, Bold=False, HorizontalAlignment=0, VerticalAlignment=0)
