# Grasshopper definition bowerbird 03 tunel struktura zebrowa cylindry.gh (Grasshopper 0.9.76)
# plug-ins: Bowerbird

crv_przekroj_1 = Curve(<curve referenced from the Rhino model>)
crv_przekroj_5 = Curve(<curve referenced from the Rhino model>)
crv_przekroj_2 = Curve(<curve referenced from the Rhino model>)
crv_przekroj_3 = Curve(<curve referenced from the Rhino model>)
crv_przekroj_4 = Curve(<curve referenced from the Rhino model>)
crv_inny_bazowy_ksztalt = Curve([<curve referenced from the Rhino model> x5])
merge = Merge(Data1=crv_przekroj_1, Data2=crv_przekroj_2, Data3=crv_przekroj_3, Data4=crv_przekroj_4, Data5=crv_przekroj_5)

# ----
# skalowanie
# wewnetrznych
# przekrojow
panel = Panel("0.8")

crv = Curve(merge)
area = Area(Geometry=crv)  # -> Area, Centroid
scale = Scale(Geometry=crv, Center=area.Centroid, Factor=panel)  # -> Geometry, Transform
loft = Loft(Curves=scale.Geometry, Options={Adjust=False, Closed=False, LoftEnds=0, LoftSimp=0, LoftType=0, Rebuild=10, Refit=0.01})
loft_2 = Loft(Curves=crv, Options={Adjust=False, Closed=False, LoftEnds=0, LoftSimp=0, LoftType=0, Rebuild=10, Refit=0.01})
item = ListItem(List=crv, Index="0", Wrap=True)
item_2 = ListItem(List=scale.Geometry, Index="0", Wrap=True)
item_3 = ListItem(List=crv, Index="4", Wrap=True)
item_4 = ListItem(List=scale.Geometry, Index="4", Wrap=True)
loft_3 = Loft(
    Curves=[item_3, item_4],
    Options={Adjust=False, Closed=False, LoftEnds=0, LoftSimp=0, LoftType=0, Rebuild=10, Refit=0.01})
loft_4 = Loft(Curves=[item, item_2], Options={Adjust=False, Closed=False, LoftEnds=0, LoftSimp=0, LoftType=0, Rebuild=10, Refit=0.01})
merge_2 = Merge(Data1=loft_2, Data2=loft, Data3=loft_4, Data4=loft_3)  # -> flatten(Result)
join = BrepJoin(Breps=merge_2)  # -> Breps, Closed

# ----
# grubosc materialu
panel_2 = Panel("3.0")
num_grubosc_materialu = Number(panel_2)

mesh = MeshBrep(
    Brep=join.Breps,
    Settings={GridMaxCount=0, GridMinCount=16, JaggedSeams=False, MaxEdgeLength=0, MinEdgeLength=0.0001, MinTolerance=0, Refine=True, RefineAngle=0, RelativeTolerance=0.65, SimplePlanes=True, Tolerance=0})
bbwaffle = BBWaffle(
    Mesh=mesh,
    CountX=Slider(8, range=0..20),
    CountY=Slider(10, range=0..20),
    Thickness=num_grubosc_materialu,
    Plane=PlaneXY(0, 0, 0),
    Deeper=0,
    Project=False,
    Distance=1)  # -> SlicesU, SlicesV, SectionPlanesU, SectionPlanesV
panel_3 = Panel(bbwaffle.SlicesU)

# ----
# bake 3d
pln_plaszczyzny_kierunek_u = Plane(bbwaffle.SectionPlanesV)
crv_przekroje_kierunek_u = Curve(bbwaffle.SlicesV)

lng = ListLength(List=flatten(pln_plaszczyzny_kierunek_u))
pt = ConstructPoint(XCoordinate=Slider(700, range=0..700), YCoordinate=0, ZCoordinate=0)
pdecon = Deconstruct(Point=pt)  # -> XComponent, YComponent, ZComponent
series = Series(Start=0, Step=Slider(148, range=0..500), Count=lng)
pt_2 = ConstructPoint(XCoordinate=pdecon.XComponent, YCoordinate=series, ZCoordinate=0)
xy = XYPlane(Origin=graft(pt_2))
simplify = SimplifyTree(Tree=xy, Front=False)
simplify_2 = SimplifyTree(Tree=pln_plaszczyzny_kierunek_u, Front=False)
simplify_3 = SimplifyTree(Tree=crv_przekroje_kierunek_u, Front=False)
orient = Orient(Geometry=simplify_3, Source=simplify_2, Target=simplify)  # -> Geometry, Transform
item_5 = ListItem(List=orient.Geometry, Index=0, Wrap=True)
curvepoint = PointOnCurve(item_5, parameter=0.549)
xy_2 = XYPlane(Origin=flatten(curvepoint))
lng_2 = ListLength(List=xy_2)
series_2 = Series(Start=1, Step=1, Count=lng_2)
int = Integer(series_2)
concat = Concatenate(FragmentA="Y", FragmentB=int)
bbtext = BBText(Location=xy_2, Text=concat, Size="10", Bold=False, HorizontalAlignment=0, VerticalAlignment=0)

# ----
# bake 3d
pln_plaszczyzny_kierunek_u_2 = Plane(bbwaffle.SectionPlanesU)
crv_przekroje_kierunek_u_2 = Curve(bbwaffle.SlicesU)

lng_3 = ListLength(List=flatten(pln_plaszczyzny_kierunek_u_2))
pt_3 = ConstructPoint(XCoordinate=Slider(289, range=0..500), YCoordinate=0, ZCoordinate=0)
pdecon_2 = Deconstruct(Point=pt_3)  # -> XComponent, YComponent, ZComponent
series_3 = Series(Start=0, Step=Slider(148, range=0..500), Count=lng_3)
pt_4 = ConstructPoint(XCoordinate=pdecon_2.XComponent, YCoordinate=series_3, ZCoordinate=0)
xy_3 = XYPlane(Origin=graft(pt_4))
simplify_4 = SimplifyTree(Tree=xy_3, Front=False)
simplify_5 = SimplifyTree(Tree=pln_plaszczyzny_kierunek_u_2, Front=False)
simplify_6 = SimplifyTree(Tree=crv_przekroje_kierunek_u_2, Front=False)
orient_2 = Orient(Geometry=simplify_6, Source=simplify_5, Target=simplify_4)  # -> Geometry, Transform
item_6 = ListItem(List=orient_2.Geometry, Index=0, Wrap=True)
curvepoint_2 = PointOnCurve(item_6, parameter=0.549)
xy_4 = XYPlane(Origin=flatten(curvepoint_2))
lng_4 = ListLength(List=xy_4)
series_4 = Series(Start=1, Step=1, Count=lng_4)
int_2 = Integer(series_4)
concat_2 = Concatenate(FragmentA="X", FragmentB=int_2)
bbtext_2 = BBText(Location=xy_4, Text=concat_2, Size="10", Bold=False, HorizontalAlignment=0, VerticalAlignment=0)
