# Grasshopper definition cellular automata Conway Game of Life 3d history.gh (Grasshopper 0.9.76)
# plug-ins: Human, Rabbit

# ---- group: Initial Configuration / Popular Configurations
the_queen_bee_shuttle = Point([Point(211, 212, 0), Point(220, 212, 0), Point(231, 203, 0), Point(238, 195, 0), Point(237, 184, 0), Point(239, 174, 0), Point(229, 167, 0), Point(220, 159, 0), Point(209, 159, 0)])
r_pentonimo = Point([Point(221, 178, 0), Point(229, 175, 0), Point(230, 185, 0), Point(237, 185, 0), Point(228, 167, 0)])
die_hard = Point([Point(94, 149, 0), Point(103, 149, 0), Point(104, 140, 0), Point(140, 140, 0), Point(148, 140, 0), Point(158, 138, 0), Point(148, 158, 0)])
gliders = Point([Point(95, 274, 0), Point(103, 266, 0), Point(113, 266, 0), Point(105, 255, 0), Point(95, 257, 0), Point(337, 194, 0), Point(328, 183, 0), Point(317, 184, 0), Point(328, 176, 0), Point(336, 175, 0)])

# ---- group: 2D Cellular Space
y_dimension = Slider(43, range=1..50)
x_dimension = Slider(50, range=1..51)
spacing = Slider(9, range=0..10)
sqgrid = Square(Plane=PlaneXY(0, 0, 0), Size=spacing, ExtentX=x_dimension, ExtentY=y_dimension)  # -> Cells, Points
pcen = PolygonCenter(Polyline=sqgrid.Cells)  # -> CenterV, CenterE

# ---- group: Initial Configuration
custom = Point([Point(465.9230752, 240.8456072, 0), Point(467.8298635, 253.7693904, 0), Point(467.9398066, 260.3354176, 0), Point(469.6993842, 270.1290839, 0), Point(476.2306708, 269.8657665, 0)])
alive = Boolean(True)
c_state = CustomStateConfiguration(Points=the_queen_bee_shuttle, CustomInitialState=alive)

# ---- group: Evolution Rules
survive = Slider(2, range=0..10)
born = Slider(3, range=0..10)
survive_2 = Slider(3, range=0..10)
life_cell = LifeLikeCell(BornRulesNumberOfNeigbors=born, SurviveRulesNumberOfNeighbors=[survive, survive_2])

# ----
panel = Panel(life_cell)
c_grid = CellularGrid(CellPrototype=life_cell, GridOfPoints=pcen.CenterV, StateConfiguration=c_state)

# ---- group: TIME CONTROLLER
timer = Timer(TimerInterval=500, Target=time)  # disabled
reset = BooleanToggle(True)
manual_time_control = Slider(0, range=0..200)
time = DiscreteTime(Reset=reset)
panel_2 = Panel(time)

# ----
ca_evolver = CAEvolver(DiscreteTime=panel_2, CellularAutomata=c_grid)  # -> CAConfiguration, Memory

# ---- group: Create Box For Each Alive Cell
list = ValueList({"Dead": false, "Alive": true}, selected="Alive")
cells = ListCells(CellularAutomatonConfiguration=ca_evolver.CAConfiguration, FilterState=list)  # -> PointCellS, CellState, Time
box_depth = Slider(4.5, range=0..10)
box_height = Slider(4.5, range=0..10)
box_width = Slider(4.5, range=0..10)
box = CenterBox(Base=cells.PointCellS, X=box_width, Y=box_depth, Z=box_height)

# ----
mbox = MeshBox(Base=box, XCount="1", YCount="1", ZCount="1")
multiplication = Multiplication(A=box_height, B=panel_2)
multiplication_2 = Multiplication(A=multiplication, B="2")
Z = UnitZ(Factor=multiplication_2)
move = Move(Geometry=box, Motion=Z)  # -> Geometry, Transform
bake = BakeGeometry(Bake=Toggle(True), Geometry=move.Geometry)
