# Grasshopper definition milipede 3d 01 krzeslo.gh (Grasshopper 0.9.76)
# plug-ins: Millipede

crv = Curve(<curve referenced from the Rhino model>)

brep_support = Brep([<brep referenced from the Rhino model> x3])
mat = MillC_StockSupportType(X=True, Y=True, Z=True, RX=True, RY=True, RZ=True)
support = _3DSupportRegion(Boundary=brep_support, SupportType=mat, AmendExistingSupports=True)

curvepoint = PointOnCurve(crv, parameter=0)
brep_boundary_void = Brep(<brep referenced from the Rhino model>)
curvepoint_2 = PointOnCurve(crv, parameter=1)

brep_boundary = Brep([<brep referenced from the Rhino model> x2])
boundary = _3DBoundaryRegion(Boundary=brep_boundary, IsVoid=Toggle(False))

# ----
# BREP INPUT
brep_weight = Brep(<brep referenced from the Rhino model>)
brep_weight_2 = Brep(<brep referenced from the Rhino model>)
vec2pt = Vector2Pt(PointA=curvepoint, PointB=curvepoint_2, Unitize=False)  # -> Vector, Length
neg = Negative(Value=Slider(81627.885, range=0..500000))
neg_2 = Negative(Value=Slider(7700, range=0..500000))
unit = UnitVector(Vector=vec2pt.Vector)
Z = UnitZ(Factor=neg)
Z_2 = UnitZ(Factor=neg_2)  # disabled
Y = UnitY(Factor=neg_2)
multiplication = Multiplication(A=neg_2, B=unit)
boundary_2 = _3DBoundaryRegion(Boundary=brep_boundary_void, IsVoid=Toggle(True))
load = _3DLoadRegion(Boundary=brep_weight, Load=Z)
load_2 = _3DLoadRegion(Boundary=brep_weight_2, Load=multiplication)

slider_xr = Slider(30, range=2..100)
slider_target_density = Slider(0.15, range=0..1)
slider_iterations = Slider(20, range=0..40)
slider_smoothing = Slider(0.13, range=0..1)
topostruct_3d = Topostruct3DModel(ModelComponents=[load, load_2, support, boundary], XResolution=slider_xr)  # -> FEModel, CellCentres, CellSize
topostruct_3d_solver = Topostruct3DSolver(
    FEModel=topostruct_3d.FEModel,
    SelfWeightCoefficient=0,
    OptimisationIterations=slider_iterations,
    Smoothing=slider_smoothing,
    Penalization=3,
    TargetDensity=slider_target_density,
    MinimumDensity=0.001,
    DeleteThreshold=0.5,
    PeriodicX=False,
    PeriodicY=False,
    PeriodicZ=False,
    LoadCase=0,
    AllCases=True)  # -> FEModel, MaxDeflection

division = Division(A=Slider(0, range=0..10), B=topostruct_3d_solver.MaxDeflection)

transparency = Slider(0.058, range=0..1)
_3d_cell_results = _3DCellResults(FEModel=topostruct_3d_solver.FEModel)  # -> PrincipalStressPlanes, PrincipalStresses, VonMisesStress, Density
multiplication_2 = Multiplication(A=_3d_cell_results.Density, B=transparency)
c_script = CSharpScript(x=multiplication_2)  # -> out, A; inputs x: Double
# ---------- c_script: C# ----------
    if (x <= 0.01) A = rn.NextDouble() * 0.01;
    else if (x > 1.0) A = 1.0;
    else A = x;
# ---------- c_script: C# additional code ----------
  Random rn = new Random();
# ---------- end c_script ----------
frgb = ColourRGBF(Alpha=c_script.A, Red=c_script.A, Green=c_script.A, Blue=c_script.A)
cloud = CloudDisplay(Points=_3d_cell_results.PrincipalStressPlanes, Colours=frgb, Size=Slider(1, range=0..1), SpriteType=0)

_3d_iso_mesh = _3DIsoMesh(FEModel=topostruct_3d_solver.FEModel, Deflection=division, IsoContourValue=Slider(0.28, range=0..1), ColorMode=3)
preview = CustomPreview(Geometry=_3d_iso_mesh, Shader=ColourSwatch(SwatchColor=RGB(181, 181, 181)))

_3d_mesh_results = _3DMeshResults(FEModel=topostruct_3d_solver.FEModel, Deflection=division, ColorMode=3)
preview_2 = CustomPreview(Geometry=_3d_mesh_results, Shader=ColourSwatch(SwatchColor=RGBA(191, 191, 191, 70)))
