# Grasshopper definition milipede 3d 01.gh (Grasshopper 0.9.76)
# plug-ins: Millipede, Weaverbird

brep_boundary = Brep([<brep referenced from the Rhino model> x2])
boundary = _3DBoundaryRegion(Boundary=brep_boundary, IsVoid=Toggle(False))

brep_support = Brep([<brep referenced from the Rhino model> x4])
mat = MillC_StockSupportType(X=True, Y=True, Z=True, RX=True, RY=True, RZ=True)
support = _3DSupportRegion(Boundary=brep_support, SupportType=mat, AmendExistingSupports=True)

brep_weight = Brep([<brep referenced from the Rhino model> x2])
neg = Negative(Value=Slider(161499.9, range=0..500000))
Z = UnitZ(Factor=neg)
load = _3DLoadRegion(Boundary=brep_weight, Load=Z)

topostruct_3d = Topostruct3DModel(ModelComponents=[boundary, support, load], XResolution=Slider(20, range=2..100))  # -> FEModel, CellCentres, CellSize
topostruct_3d_solver = Topostruct3DSolver(
    FEModel=topostruct_3d.FEModel,
    SelfWeightCoefficient=0,
    OptimisationIterations=Slider(4, range=0..10),
    Smoothing=Slider(0.13, range=0..1),
    Penalization=3,
    TargetDensity=Slider(0.2, range=0..1),
    MinimumDensity=0.001,
    DeleteThreshold=0.5,
    PeriodicX=False,
    PeriodicY=False,
    PeriodicZ=False,
    LoadCase=0,
    AllCases=True)  # -> FEModel, MaxDeflection

division = Division(A=Slider(0, range=0..10), B=topostruct_3d_solver.MaxDeflection)

transparency = Slider(0.058, range=0..1)
_3d_cell_results = _3DCellResults(FEModel=topostruct_3d_solver.FEModel)  # -> PrincipalStressPlanes, PrincipalStresses, VonMisesStress, Density
multiplication = Multiplication(A=_3d_cell_results.Density, B=transparency)
c_script = CSharpScript(x=multiplication)  # -> out, A; inputs x: Double
# ---------- c_script: C# ----------
    if (x <= 0.01) A = rn.NextDouble() * 0.01;
    else if (x > 1.0) A = 1.0;
    else A = x;
# ---------- c_script: C# additional code ----------
  Random rn = new Random();
# ---------- end c_script ----------
frgb = ColourRGBF(Alpha=c_script.A, Red=c_script.A, Green=c_script.A, Blue=c_script.A)
cloud = CloudDisplay(Points=_3d_cell_results.PrincipalStressPlanes, Colours=frgb, Size=Slider(1, range=0..1), SpriteType=0)

_3d_iso_mesh = _3DIsoMesh(FEModel=topostruct_3d_solver.FEModel, Deflection=division, IsoContourValue=Slider(0.28, range=0..1), ColorMode=3)
preview = CustomPreview(Geometry=_3d_iso_mesh, Shader=ColourSwatch(SwatchColor=RGB(181, 181, 181)))

_3d_mesh_results = _3DMeshResults(FEModel=topostruct_3d_solver.FEModel, Deflection=division, ColorMode=3)
preview_2 = CustomPreview(Geometry=_3d_mesh_results, Shader=ColourSwatch(SwatchColor=RGBA(191, 191, 191, 70)))

wbcatmullclark = WeaverbirdsCatmullClarkSubdivision(MeshCurves=_3d_iso_mesh, Level=1, SmoothNakedEdges=1)
