# Grasshopper definition milipede gyroid 01.gh (Grasshopper 0.9.76)
# plug-ins: MeshEdit Components, Millipede, Weaverbird

# ---- group: Define Density
pi = Pi(Factor=Slider(-1, range=-4..0))
pi_2 = Pi(Factor=Slider(2.1, range=0..4))
dom = Domain(DomainStart=pi, DomainEnd=pi_2)

# ----
# Make surface smoother
xyz_resolution = Slider(30, range=0..50)

# ----
# Scale and rotate
# GYROID BOX 1
# BBox
# Rotating
rotating_angle = Slider(0, range=0..1.57)
slider = Slider(9.533, range=0..20)
box = CenterBox(Base=PlaneXY(0, 0, 0), X=slider, Y=slider, Z=slider)
rotate = Rotate(Geometry=box, Angle=rotating_angle, Plane=PlaneXY(0, 0, 0))  # -> Geometry, Transform

gyroid = Panel("cos(x)*sin(y)+cos(y)*sin(z)+cos(z)*sin(x)")
range = Range(Domain=dom, Steps=xyz_resolution)
isovalue = Slider(-1.178, range=-2..5)
pt = PointXYZ(XComponent=range, YComponent=range, ZComponent=range, System=PlaneXY(0, 0, 0), DataComparison="cross_reference")
addition = Addition(A=xyz_resolution, B=1)
pcomp = Decompose(Point=pt, System=PlaneXY(0, 0, 0))  # -> XComponent, YComponent, ZComponent
eval = Evaluate(F=gyroid, x=pcomp.XComponent, y=pcomp.YComponent, z=pcomp.ZComponent)
iso_surface = IsoSurface(
    Box=rotate.Geometry,
    Values=eval,
    XResolution=addition,
    YResolution=addition,
    ZResolution=addition,
    IsoValue=isovalue,
    MergeVertices=True)
mesh = Mesh(iso_surface)
weldvertices = MeshWeldVertices(Mesh=mesh, Tolerance=0.01)  # -> RuntimeMessage, Mesh
wblaplace = WeaverBirdsLaplacianSmoothing(MeshCurves=weldvertices.Mesh, Level=2, SmoothNakedEdges=0, Thin=1)
mesh_2 = Mesh(wblaplace)
wbthicken = WeaverbirdsMeshThicken(MeshCurves=mesh_2, Distance=Slider(1, range=0..3), OffsetType=0)
