# Grasshopper definition weaverbird + exoskeleton 01.gh (Grasshopper 0.9.76)
# plug-ins: Exoskeleton2, Kangaroo Components, Weaverbird

number_slider = Slider(20, range=0..20)
multiplication = Multiplication(A=number_slider, B="2")
division = Division(A=number_slider, B="2")
box = CenterBox(Base=PlaneXY(0, 0, 0), X=division, Y=division, Z=multiplication)
box_2 = CenterBox(Base=PlaneXY(0, 0, 0), X=number_slider, Y=number_slider, Z=number_slider)
box_3 = CenterBox(Base=PlaneXY(0, 0, 0), X=division, Y=multiplication, Z=division)
box_4 = CenterBox(Base=PlaneXY(0, 0, 0), X=multiplication, Y=division, Z=division)
sdiff = SolidDifference(BrepsA=box_2, BrepsB=[box_4, box_3, box])
mesh = MeshBrep(
    Brep=sdiff,
    Settings={GridMaxCount=0, GridMinCount=16, JaggedSeams=False, MaxEdgeLength=0, MinEdgeLength=0.0001, MinTolerance=0, Refine=True, RefineAngle=0, RelativeTolerance=0.65, SimplePlanes=True, Tolerance=0})
wbcatmullclark = WeaverbirdsCatmullClarkSubdivision(MeshCurves=mesh, Level=3, SmoothNakedEdges=1)
demesh = DeconstructMesh(Mesh=wbcatmullclark)  # -> Vertices, Faces, Colours, Normals
deface = DeconstructFace(Face=demesh.Faces)  # -> CornerA, CornerB, CornerC, CornerD
item = ListItem(List=demesh.Vertices, Index=deface.CornerA, Wrap=True)
item_2 = ListItem(List=demesh.Vertices, Index=deface.CornerB, Wrap=True)
item_3 = ListItem(List=demesh.Vertices, Index=deface.CornerC, Wrap=True)
item_4 = ListItem(List=demesh.Vertices, Index=deface.CornerD, Wrap=True)
ln = Line(StartPoint=item, EndPoint=item_4)
ln_2 = Line(StartPoint=item_3, EndPoint=item_4)
ln_3 = Line(StartPoint=item_2, EndPoint=item_3)
ln_4 = Line(StartPoint=item, EndPoint=item_2)
merge = Merge(Data1=ln_4, Data2=ln_3, Data3=ln_2, Data4=ln)
dupln = RemoveDuplicateLines(Lines=merge, Tolerance=0.1)
exow = ExoWireframe(Lines=dupln, Sides=6, StartRadius="0.3", EndRadius="0.3", NodeDepth=0, Division="2", Open=False)
wbcatmullclark_2 = WeaverbirdsCatmullClarkSubdivision(MeshCurves=exow, Level=1, SmoothNakedEdges=1)
