# Grasshopper definition weaverbird + exoskeleton 02.gh (Grasshopper 0.9.76)
# plug-ins: MeshEdit Components, Exoskeleton2, Weaverbird

base_srf_shape_depth = Slider(11, range=1..90)  # disabled
base_width = Slider(64, range=1..90)  # disabled
total_depth = Slider(19, range=0..60)  # disabled
div_v = Slider(4, range=0..20)  # disabled
div_u = Slider(8, range=0..20)  # disabled
srf_radius = Slider(26, range=1..40)  # disabled
arc_cut = Slider(45, range=1..90)  # disabled

# ----
# top surface generation
dom = ConstructDomain(DomainStart=arc_cut, DomainEnd=expr("180-x", arc_cut))  # disabled
rad = Radians(Degrees=dom)  # disabled
xz = XZPlane(Origin=Point(0, 0, 0))  # disabled
arc = Arc(Plane=xz, Radius=srf_radius, Angle=rad)  # -> Arc, Length; disabled
vec = VectorXYZ(XComponent=0, YComponent=expr("x/2", base_width), ZComponent=expr("-x", base_srf_shape_depth))  # -> Vector, Length; disabled
Y = UnitY(Factor=base_width)  # disabled
rotate = Rotate(Geometry=arc.Arc, Angle=degrees(arc_cut), Plane=xz)  # -> Geometry, Transform; disabled
move = Move(Geometry=rotate.Geometry, Motion=vec.Vector)  # -> Geometry, Transform; disabled
move_2 = Move(Geometry=rotate.Geometry, Motion=Y)  # -> Geometry, Transform; disabled
loft = Loft(
    Curves=[rotate.Geometry, move.Geometry, move_2.Geometry],
    Options={Adjust=False, Closed=False, LoftEnds=0, LoftSimp=0, LoftType=0, Rebuild=10, Refit=0.01})  # disabled

Z = UnitZ(Factor=expr("-x/2", total_depth))  # disabled
Z_2 = UnitZ(Factor=expr("-x", total_depth))  # disabled
mesh_uv = MeshSurface(Surface=loft, UCount=div_u, VCount=div_v, Overhang=False, Equalize=False)  # disabled
move_3 = Move(Geometry=mesh_uv, Motion=Z_2)  # -> Geometry, Transform; disabled
move_4 = Move(Geometry=mesh_uv, Motion=Z)  # -> Geometry, Transform; disabled
cluster = Cluster(mesh_input=mesh_uv)  # disabled
cluster_2 = Cluster(mesh_input=move_4.Geometry)  # disabled
cluster_3 = Cluster(mesh_input=move_3.Geometry)  # disabled
cluster_4 = Cluster_2(crv_top_lines=cluster_2, crv_bottom_lines=cluster_3)  # disabled
cluster_5 = Cluster_2(crv_top_lines=cluster, crv_bottom_lines=cluster_2)  # disabled
crv_srf_bottom = Curve(cluster_3)  # disabled
crv_srf_top = Curve(cluster)  # disabled
crv_srf_mid = Curve(cluster_2)  # disabled
crv = Curve(flatten([cluster_5, cluster_4]))  # disabled
merge = Merge(Data1=crv_srf_top, Data2=crv_srf_mid, Data3=crv_srf_bottom, Data4=crv)  # -> flatten(Result); disabled
number_slider = Slider(0, range=-50..50)  # disabled
number_slider_2 = Slider(0, range=-50..50)  # disabled
number_slider_3 = Slider(0, range=-50..50)  # disabled
number_slider_4 = Slider(0.32, range=0..2)  # disabled
number_slider_5 = Slider(1, range=0..2)  # disabled
curvepoint = PointOnCurve(merge, parameter=1)  # disabled
curvepoint_2 = PointOnCurve(merge, parameter=0)  # disabled
curvepoint_3 = PointOnCurve(merge, parameter=0.5)  # disabled
merge_2 = Merge(Data1=curvepoint_2, Data2=curvepoint)  # disabled
pt = ConstructPoint(XCoordinate=number_slider, YCoordinate=number_slider_2, ZCoordinate=number_slider_3)  # disabled
dom_2 = ConstructDomain(DomainStart=number_slider_4, DomainEnd=number_slider_5)  # disabled
dist = Distance(PointA=pt, PointB=curvepoint_3)  # disabled
bnd = Bounds(Numbers=dist)  # disabled
remap = RemapNumbers(Value=dist, Source=bnd, Target=dom_2)  # -> Mapped, Clipped; disabled
panel = Panel("30")  # disabled
dispatch = Dispatch(List=remap.Mapped, DispatchPattern=[False, True])  # -> ListA, ListB; disabled
exow = ExoWireframe(Lines=merge, Sides=6, StartRadius=remap.Mapped, EndRadius=remap.Mapped, NodeDepth=0, Division=panel, Open=False)  # disabled
wbloop = WeaverbirdsLoopSubdivision(MeshCurves=exow, Level=2, SmoothNakedEdges=1)  # disabled
wbcatmullclark = WeaverbirdsCatmullClarkSubdivision(MeshCurves=exow, Level=3, SmoothNakedEdges=0)  # disabled
wblaplace = WeaverbirdsLaplacianSmoothing(MeshCurves=wbloop, Level=3, SmoothNakedEdges=1, Thin=1)  # disabled

# ----
# przesuniecie siatki w gore
# i polaczenie pionowymi liniami
base_srf_shape_depth_2 = Slider(11, range=1..90)
base_width_2 = Slider(64, range=1..90)
div_v_2 = Slider(4, range=0..20)
div_u_2 = Slider(8, range=0..20)
srf_radius_2 = Slider(26, range=1..40)
arc_cut_2 = Slider(45, range=1..90)
Z_3 = UnitZ(Factor=Slider(10, range=0..20))
pt_2 = ConstructPoint(XCoordinate=Slider(0, range=-50..50), YCoordinate=Slider(0, range=-50..50), ZCoordinate=Slider(0, range=-50..50))
dom_3 = ConstructDomain(DomainStart=Slider(0.6, range=0..2), DomainEnd=Slider(2.05, range=0..4))

# ----
# top surface generation
dom_4 = ConstructDomain(DomainStart=arc_cut_2, DomainEnd=expr("180-x", arc_cut_2))
rad_2 = Radians(Degrees=dom_4)
xz_2 = XZPlane(Origin=Point(0, 0, 0))
arc_2 = Arc(Plane=xz_2, Radius=srf_radius_2, Angle=rad_2)  # -> Arc, Length
vec_2 = VectorXYZ(XComponent=0, YComponent=expr("x/2", base_width_2), ZComponent=expr("-x", base_srf_shape_depth_2))  # -> Vector, Length
Y_2 = UnitY(Factor=base_width_2)
rotate_2 = Rotate(Geometry=arc_2.Arc, Angle=degrees(arc_cut_2), Plane=xz_2)  # -> Geometry, Transform
move_5 = Move(Geometry=rotate_2.Geometry, Motion=vec_2.Vector)  # -> Geometry, Transform
move_6 = Move(Geometry=rotate_2.Geometry, Motion=Y_2)  # -> Geometry, Transform
loft_2 = Loft(
    Curves=[rotate_2.Geometry, move_5.Geometry, move_6.Geometry],
    Options={Adjust=False, Closed=False, LoftEnds=0, LoftSimp=0, LoftType=0, Rebuild=10, Refit=0.01})

base_srf_shape_depth_3 = Slider(11, range=1..90)
base_width_3 = Slider(64, range=1..90)
div_v_3 = Slider(4, range=0..20)
div_u_3 = Slider(8, range=0..20)
srf_radius_3 = Slider(26, range=1..40)
arc_cut_3 = Slider(45, range=1..90)
pt_3 = ConstructPoint(XCoordinate=Slider(0, range=-50..50), YCoordinate=Slider(0, range=-50..50), ZCoordinate=Slider(0, range=-50..50))
dom_5 = ConstructDomain(DomainStart=Slider(0.7, range=0..2), DomainEnd=Slider(1.8, range=0..2))

# ----
# top surface generation
dom_6 = ConstructDomain(DomainStart=arc_cut_3, DomainEnd=expr("180-x", arc_cut_3))
rad_3 = Radians(Degrees=dom_6)
xz_3 = XZPlane(Origin=Point(0, 0, 0))
arc_3 = Arc(Plane=xz_3, Radius=srf_radius_3, Angle=rad_3)  # -> Arc, Length
vec_3 = VectorXYZ(XComponent=0, YComponent=expr("x/2", base_width_3), ZComponent=expr("-x", base_srf_shape_depth_3))  # -> Vector, Length
Y_3 = UnitY(Factor=base_width_3)
rotate_3 = Rotate(Geometry=arc_3.Arc, Angle=degrees(arc_cut_3), Plane=xz_3)  # -> Geometry, Transform
move_7 = Move(Geometry=rotate_3.Geometry, Motion=vec_3.Vector)  # -> Geometry, Transform
move_8 = Move(Geometry=rotate_3.Geometry, Motion=Y_3)  # -> Geometry, Transform
loft_3 = Loft(
    Curves=[rotate_3.Geometry, move_7.Geometry, move_8.Geometry],
    Options={Adjust=False, Closed=False, LoftEnds=0, LoftSimp=0, LoftType=0, Rebuild=10, Refit=0.01})

mesh_uv_2 = MeshSurface(Surface=loft_2, UCount=div_u_2, VCount=div_v_2, Overhang=False, Equalize=False)

# ----
# pozniej zamiana tego
# fragmentu na cluster
mesh_input = Mesh(mesh_uv_2)
explode = MeshExplode(Mesh=mesh_input, Interpolate=False)
demesh = DeconstructMesh(Mesh=explode)  # -> Vertices, Faces, Colours, Normals
area = MeshArea(Mesh=explode)  # -> Area, Centroid
simplify = SimplifyTree(Tree=graft(area.Centroid), Front=False)
simplify_2 = SimplifyTree(Tree=demesh.Vertices, Front=False)
ln = Line(StartPoint=simplify, EndPoint=simplify_2)
crv_lines = Curve(flatten(ln))

move_9 = Move(Geometry=ln, Motion=Z_3)  # -> Geometry, Transform
move_10 = Move(Geometry=simplify, Motion=Z_3)  # -> Geometry, Transform
ln_2 = Line(StartPoint=simplify, EndPoint=move_10.Geometry)
merge_3 = Merge(Data1=crv_lines, Data2=ln_2, Data3=move_9.Geometry)  # -> flatten(Result)
crv_2 = Curve(flatten(merge_3))
curvepoint_4 = PointOnCurve(crv_2, parameter=0.5)
dist_2 = Distance(PointA=pt_2, PointB=curvepoint_4)
bnd_2 = Bounds(Numbers=dist_2)
remap_2 = RemapNumbers(Value=dist_2, Source=bnd_2, Target=dom_3)  # -> Mapped, Clipped
exow_2 = ExoWireframe(Lines=crv_2, Sides=6, StartRadius=remap_2.Mapped, EndRadius=remap_2.Mapped, NodeDepth=0, Division="30", Open=False)
wbcatmullclark_2 = WeaverbirdsCatmullClarkSubdivision(MeshCurves=exow_2, Level=3, SmoothNakedEdges=0)
wblaplace_2 = WeaverbirdsLaplacianSmoothing(MeshCurves=exow_2, Level=3, SmoothNakedEdges=1, Thin=1)
wbloop_2 = WeaverbirdsLoopSubdivision(MeshCurves=exow_2, Level=2, SmoothNakedEdges=1)

mesh_uv_3 = MeshSurface(Surface=loft_3, UCount=div_u_3, VCount=div_v_3, Overhang=False, Equalize=False)

# ----
# pozniej zamiana tego
# fragmentu na cluster
mesh_input_2 = Mesh(mesh_uv_3)
explode_2 = MeshExplode(Mesh=mesh_input_2, Interpolate=False)
demesh_2 = DeconstructMesh(Mesh=explode_2)  # -> Vertices, Faces, Colours, Normals
area_2 = MeshArea(Mesh=explode_2)  # -> Area, Centroid
simplify_3 = SimplifyTree(Tree=graft(area_2.Centroid), Front=False)
simplify_4 = SimplifyTree(Tree=demesh_2.Vertices, Front=False)
ln_3 = Line(StartPoint=simplify_3, EndPoint=simplify_4)
crv_lines_2 = Curve(flatten(ln_3))

curvepoint_5 = PointOnCurve(crv_lines_2, parameter=0.5)
dist_3 = Distance(PointA=pt_3, PointB=curvepoint_5)
bnd_3 = Bounds(Numbers=dist_3)
remap_3 = RemapNumbers(Value=dist_3, Source=bnd_3, Target=dom_5)  # -> Mapped, Clipped
exow_3 = ExoWireframe(Lines=crv_lines_2, Sides=6, StartRadius=remap_3.Mapped, EndRadius=remap_3.Mapped, NodeDepth=0, Division="30", Open=False)
wbcatmullclark_3 = WeaverbirdsCatmullClarkSubdivision(MeshCurves=exow_3, Level=3, SmoothNakedEdges=0)
wblaplace_3 = WeaverbirdsLaplacianSmoothing(MeshCurves=exow_3, Level=3, SmoothNakedEdges=1, Thin=1)
wbloop_3 = WeaverbirdsLoopSubdivision(MeshCurves=exow_3, Level=2, SmoothNakedEdges=1)

# ==== cluster Cluster
mesh_input = ClusterInput()
mesh_input_2 = Mesh(mesh_input)
explode = MeshExplode(Mesh=mesh_input_2, Interpolate=False)
demesh = DeconstructMesh(Mesh=explode)  # -> Vertices, Faces, Colours, Normals
area = MeshArea(Mesh=explode)  # -> Area, Centroid
simplify = SimplifyTree(Tree=graft(area.Centroid), Front=False)
simplify_2 = SimplifyTree(Tree=demesh.Vertices, Front=False)
ln = Line(StartPoint=simplify, EndPoint=simplify_2)
crv_lines = Curve(ln)
crv_lines_2 = ClusterOutput(crv_lines)

# ==== cluster Cluster_2
crv_bottom_lines = ClusterInput()
crv_top_lines = ClusterInput()
crv_bottom_lines_2 = Curve(crv_bottom_lines)
crv_top_lines_2 = Curve(crv_top_lines)
item = ListItem(List=crv_top_lines_2, Index="0", Wrap=True)
item_2 = ListItem(List=crv_top_lines_2, Index="3", Wrap=True)
item_3 = ListItem(List=crv_bottom_lines_2, Index="2", Wrap=True)
item_4 = ListItem(List=crv_top_lines_2, Index="2", Wrap=True)
item_5 = ListItem(List=crv_bottom_lines_2, Index="2", Wrap=True)
curvepoint = PointOnCurve(item, parameter=1)
curvepoint_2 = PointOnCurve(item_2, parameter=1)
curvepoint_3 = PointOnCurve(item_3, parameter=1)
curvepoint_4 = PointOnCurve(item_4, parameter=1)
curvepoint_5 = PointOnCurve(item_5, parameter=1)
ln = Line(StartPoint=curvepoint, EndPoint=curvepoint_3)
ln_2 = Line(StartPoint=curvepoint_2, EndPoint=curvepoint_3)
ln_3 = Line(StartPoint=curvepoint_4, EndPoint=curvepoint_5)
crv_output = Curve([ln, ln_3, ln_2])
crv_output_2 = ClusterOutput(crv_output)
