# Grasshopper definition weaverbird + exoskeleton 04.gh (Grasshopper 0.9.76)
# plug-ins: MeshEdit Components, Exoskeleton2, Weaverbird

wbicosahedron = WeaverbirdsMeshMeshIcosahedron(Plane=PlaneXY(0, 0, 0), Radius=Slider(30, range=0..50))
explode = MeshExplode(Mesh=wbicosahedron, Interpolate=False)
merge = Merge(Data1=Toggle(True), Data2=Toggle(False), Data3=Toggle(True))
cull = CullPattern(List=explode, CullPattern=merge)
mjoin = MeshJoin(Meshes=cull)
wbcatmullclark = WeaverbirdsCatmullClarkSubdivision(MeshCurves=mjoin, Level="3", SmoothNakedEdges=0)
demesh = DeconstructMesh(Mesh=wbcatmullclark)  # -> Vertices, Faces, Colours, Normals
pt = ConstructPoint(XCoordinate=0, YCoordinate=0, ZCoordinate=0)
dist = Distance(PointA=pt, PointB=demesh.Vertices)
dom = ConstructDomain(DomainStart=Slider(0.3, range=0..2), DomainEnd=Slider(1.6, range=0..2))
bnd = Bounds(Numbers=dist)
remap = RemapNumbers(Value=dist, Source=bnd, Target=dom)  # -> Mapped, Clipped
cyto = Cytoskeleton(PlanktonMesh=wbcatmullclark, Radius=remap.Mapped, Dual=False)
wbcatmullclark_2 = WeaverbirdsCatmullClarkSubdivision(MeshCurves=cyto, Level="3", SmoothNakedEdges=0)
