# Grasshopper definition milipede 3d 02.gh (Grasshopper 0.9.76)
# plug-ins: Millipede, Weaverbird, Bowerbird

brep_support = Brep([<brep referenced from the Rhino model> x3])
mat = MillC_StockSupportType(X=True, Y=True, Z=True, RX=True, RY=True, RZ=True)
support = _3DSupportRegion(Boundary=brep_support, SupportType=mat, AmendExistingSupports=True)

brep_boundary = Brep(<brep referenced from the Rhino model>)
boundary = _3DBoundaryRegion(Boundary=brep_boundary, IsVoid=Toggle(False))

brep_weight = Brep(<brep referenced from the Rhino model>)
neg = Negative(Value=Slider(10000, range=0..500000))
Z = UnitZ(Factor=neg)
load = _3DLoadRegion(Boundary=brep_weight, Load=Z)

brep_boundary_2 = Brep(<brep referenced from the Rhino model>)
boundary_2 = _3DBoundaryRegion(Boundary=brep_boundary_2, IsVoid=Toggle(True))

topostruct_3d = Topostruct3DModel(ModelComponents=[boundary, support, load], XResolution=Slider(30, range=2..100))  # -> FEModel, CellCentres, CellSize
topostruct_3d_solver = Topostruct3DSolver(
    FEModel=topostruct_3d.FEModel,
    SelfWeightCoefficient=0,
    OptimisationIterations=Slider(10, range=0..40),
    Smoothing=Slider(0.13, range=0..1),
    Penalization=3,
    TargetDensity=Slider(0.3, range=0..1),
    MinimumDensity=0.001,
    DeleteThreshold=0.5,
    PeriodicX=False,
    PeriodicY=False,
    PeriodicZ=False,
    LoadCase=0,
    AllCases=True)  # -> FEModel, MaxDeflection

division = Division(A=Slider(0, range=0..10), B=topostruct_3d_solver.MaxDeflection)

number_slider = Slider(7, range=4..15)
number_slider_2 = Slider(2, range=1..4)
number_slider_3 = Slider(7, range=4..15)

transparency = Slider(0.058, range=0..1)
_3d_cell_results = _3DCellResults(FEModel=topostruct_3d_solver.FEModel)  # -> PrincipalStressPlanes, PrincipalStresses, VonMisesStress, Density
multiplication = Multiplication(A=_3d_cell_results.Density, B=transparency)
c_script = CSharpScript(x=multiplication)  # -> out, A; inputs x: Double
# ---------- c_script: C# ----------
    if (x <= 0.01) A = rn.NextDouble() * 0.01;
    else if (x > 1.0) A = 1.0;
    else A = x;
# ---------- c_script: C# additional code ----------
  Random rn = new Random();
# ---------- end c_script ----------
frgb = ColourRGBF(Alpha=c_script.A, Red=c_script.A, Green=c_script.A, Blue=c_script.A)
cloud = CloudDisplay(Points=_3d_cell_results.PrincipalStressPlanes, Colours=frgb, Size=Slider(1, range=0..1), SpriteType=0)

xy = XYPlane(Origin=Point(0, 0, 0))

_3d_iso_mesh = _3DIsoMesh(FEModel=topostruct_3d_solver.FEModel, Deflection=division, IsoContourValue=Slider(0.28, range=0..1), ColorMode=3)
preview = CustomPreview(Geometry=_3d_iso_mesh, Shader=ColourSwatch(SwatchColor=RGB(181, 181, 181)))

rotate = Rotate(Geometry=xy, Angle=degrees(Slider(45, range=-90..90)), Plane=PlaneXY(0, 0, 0))  # -> Geometry, Transform
X = UnitX(Factor=1)

_3d_mesh_results = _3DMeshResults(FEModel=topostruct_3d_solver.FEModel, Deflection=division, ColorMode=3)
preview_2 = CustomPreview(Geometry=_3d_mesh_results, Shader=ColourSwatch(SwatchColor=RGBA(191, 191, 191, 70)))

rot3d = Rotate3D(Geometry=rotate.Geometry, Angle=degrees(Slider(-45, range=-90..90)), Center=Point(0, 0, 0), Axis=X)  # -> Geometry, Transform
wbcatmullclark = WeaverbirdsCatmullClarkSubdivision(MeshCurves=_3d_iso_mesh, Level=1, SmoothNakedEdges=1)
mesh = Mesh(wbcatmullclark)
bbwaffle = BBWaffle(
    Mesh=mesh,
    CountX=number_slider,
    CountY=number_slider_3,
    Thickness=number_slider_2,
    Plane=rot3d.Geometry,
    Deeper=0,
    Project=False,
    Distance=1)  # -> SlicesU, SlicesV, SectionPlanesU, SectionPlanesV
bbwaffle_2 = BBWaffle(
    Mesh=mesh,
    CountX=number_slider,
    CountY=number_slider_3,
    Thickness=number_slider_2,
    Plane=rot3d.Geometry,
    Deeper=0,
    Project=True,
    Distance=1)  # -> SlicesU, SlicesV, flatten(SectionPlanesU), flatten(SectionPlanesV)
srf = Surface(bbwaffle.SlicesV)
srf_2 = Surface(bbwaffle.SlicesU)
Y = UnitY(Factor="100")

lng = ListLength(List=bbwaffle_2.SectionPlanesV)
item = ListItem(List=bbwaffle_2.SlicesV, Index=0, Wrap=True)
md_slider = MDSlider(
    slider_value=Point(0.6906280518, 0.5875015259, 0.5),
    SliderMode=0,
    x_domain=Domain(0, 1),
    y_domain=Domain(0, 1),
    z_domain=Domain(0, 1))
series = Series(Start=0, Step=1, Count=lng)
evalsrf = EvaluateSurface(Surface=reparameterize(item), Point=md_slider)  # -> flatten(Point), Normal, Frame
int = Integer(series)
concat = Concatenate(FragmentA="Y", FragmentB=int)
bbtext = BBText(Location=evalsrf.Point, Text=concat, Size="10", Bold=False, HorizontalAlignment=0, VerticalAlignment=0)

lng_2 = ListLength(List=bbwaffle_2.SectionPlanesU)
item_2 = ListItem(List=bbwaffle_2.SlicesU, Index=0, Wrap=True)
md_slider_2 = MDSlider(
    slider_value=Point(0.6906280518, 0.5875015259, 0.5),
    SliderMode=0,
    x_domain=Domain(0, 1),
    y_domain=Domain(0, 1),
    z_domain=Domain(0, 1))
series_2 = Series(Start=0, Step=1, Count=lng_2)
evalsrf_2 = EvaluateSurface(Surface=reparameterize(item_2), Point=md_slider_2)  # -> flatten(Point), Normal, Frame
int_2 = Integer(series_2)
concat_2 = Concatenate(FragmentA="X", FragmentB=int_2)
bbtext_2 = BBText(Location=evalsrf_2.Point, Text=concat_2, Size="10", Bold=False, HorizontalAlignment=0, VerticalAlignment=0)

move = Move(Geometry=srf, Motion=Y)  # -> Geometry, Transform
move_2 = Move(Geometry=srf_2, Motion=Y)  # -> Geometry, Transform
